# Grasshopper definition ArchSim Script.gh (Grasshopper 1.0.8)
# plug-ins: Karamba3D

trigger = Trigger(Interval=500, TimerInterval=500, Target=python_3_script)  # disabled
python_3_script = Python3Script()  # -> out, siteWidth, siteDepth, zoneMaxHeight, zoneMaxFSR, zoneFrontSetback, zoneSideSetback, zoneRearSetback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
# ---------- python_3_script: Python ----------
# ArchSim GH Inputs Reader — round-boundary sync FROM app
# ─────────────────────────────────────────────────────────────────────────────
# Reads snapshots/.gh-inputs.json (written by the app via serve.py) and
# outputs each parameter on its own output pin. Wire a GH Timer component
# into the `tick` input to drive reads at ~400-600ms.
#
# FLOW:
#   1. App (core/roundSync.js) generates a roundToken and POSTs the full
#      params payload to serve.py /gh-inputs.
#   2. serve.py atomically writes snapshots/.gh-inputs.json.
#   3. This script reads that file each timer tick and unpacks into 38
#      output pins that drive gh-massing / gh-structure / gh-windows /
#      gh-zoning-envelope / gh-params-export.
#   4. GH solves, gh-params-export.py echoes `roundToken` into params.json.
#   5. core/roundSync.js polls params.json and matches the token.
#
# INPUT:
#   tick          Any       — connect a Timer component here to drive ticks
#                             (or a button for manual refresh).
#
# OUTPUTS (all Item Access — 38 pins + status):
#
#   Site & zoning:
#     siteWidth            float
#     siteDepth            float
#     zoneMaxHeight        float
#     zoneMaxFSR           float
#     zoneFrontSetback     float
#     zoneSideSetback      float
#     zoneRearSetback      float
#     zoneMaxCoverage      float
#
#   Core geometry:
#     floors               int
#     floor_height         float
#     orientation          float
#
#   Base / top shape (gh-massing):
#     base_shape           int
#     base_scale           float
#     top_scale            float
#     top_offset_x         float
#     top_offset_y         float
#     top_rotation         float
#
#   Section typology (gh-massing):
#     section_type         int
#     podium_floors        int
#     tower_ratio          float
#     setback_depth        float
#     setback_interval     int
#     stilt_floors         int
#     stilt_col_shape      int
#     stilt_col_size       float
#     garden_interval      int
#     garden_floors        int
#
#   Plan typology (gh-massing):
#     plan_type            int
#     courtyard_ratio      float
#     void_corner          int
#     void_ratio           float
#     split_gap            float
#     bar_ratio            float
#
#   Structure (gh-structure). NOTE: structural_span is ONE pin but the user
#   wires it twice in the GH canvas — once to gh-structure.structural_span
#   and once to gh-massing.stilt_col_span (gh-massing.py:46 says the stilt
#   column span must match the structural span, so a single source of truth):
#     structural_span      float
#     lateral_system       int
#     column_shape         int     — 0=Square 1=Round
#     column_size          float   — Column width/diameter (m)
#
#   Windows (gh-windows):
#     window_type          int
#     wwRatio              float
#     bay_spacing          float
#
#   Round-token roundtrip (see core/roundSync.js + gh-params-export.py):
#     roundToken           str
#
#   status                 str  — "OK hh:mm:ss — N keys" / "waiting" / error
#
# BEHAVIOUR:
#   • If .gh-inputs.json doesn't exist yet, every pin outputs None and
#     status = "waiting for app". Downstream components should handle None
#     by falling back to native GH sliders (OR logic / Longest List etc).
#   • Caches the last successful payload in sticky globals so a transient
#     read failure doesn't collapse the graph to None.
#   • No-op if the file hasn't changed since last tick (mtime check).
# ─────────────────────────────────────────────────────────────────────────────
import os
import json
import datetime

PROJECT_PATH = r"C:\Users\Karl\Documents\UBC\MArch Yr3\Arch 549 GP2\01_Assignment\app\ClaudeCode\Claude_Project_ArchSimV2"
INPUTS_FILE  = os.path.join(PROJECT_PATH, "snapshots", ".gh-inputs.json")

# Sticky cache so a missing/locked file doesn't clear downstream values
if "_last_payload" not in globals():
    _last_payload = {}
if "_last_mtime" not in globals():
    _last_mtime = 0.0

def _safe_num(v, default=None):
    if v is None:
        return default
    try:
        return float(v)
    except:
        return default

def _safe_int(v, default=None):
    n = _safe_num(v, None)
    return int(round(n)) if n is not None else default

def _safe_str(v, default=None):
    return str(v) if v is not None else default

status_str = "waiting for app"
_payload = dict(_last_payload)

try:
    if os.path.exists(INPUTS_FILE):
        mt = os.path.getmtime(INPUTS_FILE)
        if mt != _last_mtime:
            with open(INPUTS_FILE, "r") as f:
                fresh = json.load(f)
            if isinstance(fresh, dict):
                _payload      = fresh
                _last_payload = fresh
                _last_mtime   = mt
        now = datetime.datetime.now().strftime("%H:%M:%S")
        status_str = "OK {} - {} keys".format(now, len(_payload))
    else:
        status_str = "waiting for app (no .gh-inputs.json yet)"
except Exception as e:
    status_str = "ERROR: " + str(e)

def _g(k):
    return _payload.get(k)

# ── Site & zoning ────────────────────────────────────────────────────────────
siteWidth        = _safe_num(_g("siteWidth"))
siteDepth        = _safe_num(_g("siteDepth"))
zoneMaxHeight    = _safe_num(_g("zoneMaxHeight"))
zoneMaxFSR       = _safe_num(_g("zoneMaxFSR"))
zoneFrontSetback = _safe_num(_g("zoneFrontSetback"))
zoneSideSetback  = _safe_num(_g("zoneSideSetback"))
zoneRearSetback  = _safe_num(_g("zoneRearSetback"))
zoneMaxCoverage  = _safe_num(_g("zoneMaxCoverage"))

# ── Core geometry ────────────────────────────────────────────────────────────
floors           = _safe_int(_g("floors"))
floor_height     = _safe_num(_g("floor_height") if _g("floor_height") is not None else _g("floorHeight"))
orientation      = _safe_num(_g("orientation"))

# ── Base / top shape (gh-massing) ────────────────────────────────────────────
base_shape       = _safe_int(_g("base_shape"))
base_scale       = _safe_num(_g("base_scale"))
top_scale        = _safe_num(_g("top_scale"))
top_offset_x     = _safe_num(_g("top_offset_x"))
top_offset_y     = _safe_num(_g("top_offset_y"))
top_rotation     = _safe_num(_g("top_rotation"))

# ── Section typology (gh-massing) ────────────────────────────────────────────
section_type     = _safe_int(_g("section_type") if _g("section_type") is not None else _g("sectionType"))
podium_floors    = _safe_int(_g("podium_floors"))
tower_ratio      = _safe_num(_g("tower_ratio"))
setback_depth    = _safe_num(_g("setback_depth"))
setback_interval = _safe_int(_g("setback_interval"))
stilt_floors     = _safe_int(_g("stilt_floors"))
stilt_col_shape  = _safe_int(_g("stilt_col_shape"))
stilt_col_size   = _safe_num(_g("stilt_col_size"))
garden_interval  = _safe_int(_g("garden_interval"))
garden_floors    = _safe_int(_g("garden_floors"))

# ── Plan typology (gh-massing) ───────────────────────────────────────────────
plan_type        = _safe_int(_g("plan_type") if _g("plan_type") is not None else _g("planType"))
courtyard_ratio  = _safe_num(_g("courtyard_ratio"))
void_corner      = _safe_int(_g("void_corner"))
void_ratio       = _safe_num(_g("void_ratio"))
split_gap        = _safe_num(_g("split_gap"))
bar_ratio        = _safe_num(_g("bar_ratio"))

# ── Structure (gh-structure). ONE pin, user wires it twice in the canvas ────
# (once to gh-structure.structural_span, once to gh-massing.stilt_col_span).
structural_span  = _safe_num(_g("structural_span") if _g("structural_span") is not None else _g("structuralSpan"))
lateral_system   = _safe_int(_g("lateral_system") if _g("lateral_system") is not None else _g("lateralSystem"))
column_shape     = _safe_int(_g("column_shape"))
column_size      = _safe_num(_g("column_size"))

# ── Windows (gh-windows) ─────────────────────────────────────────────────────
window_type      = _safe_int(_g("window_type") if _g("window_type") is not None else _g("windowType"))
wwRatio          = _safe_num(_g("wwRatio"))
bay_spacing      = _safe_num(_g("bay_spacing") if _g("bay_spacing") is not None else _g("baySpacing"))

# ── Round-token roundtrip ────────────────────────────────────────────────────
roundToken       = _safe_str(_g("roundToken"))

status = status_str
print(status)
# ---------- end python_3_script ----------
panel = Panel(python_3_script.out)
gh_zoning_envelope = Python3Script(
    siteWidth=python_3_script.siteWidth,
    siteDepth=python_3_script.siteDepth,
    zoneMaxHeight=python_3_script.zoneMaxHeight,
    zoneMaxFSR=python_3_script.zoneMaxFSR,
    zoneFrontSetback=python_3_script.zoneFrontSetback,
    zoneSideSetback=python_3_script.zoneSideSetback,
    zoneRearSetback=python_3_script.zoneRearSetback,
    zoneMaxCoverage=python_3_script.zoneMaxCoverage,
    floor_height=python_3_script.floor_height)  # -> out, siteBoundary, buildableFootprint, zoningEnvelope, setbackLines, siteArea, buildableArea, maxFootprint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
# ---------- gh_zoning_envelope: Python ----------
"""
ZONING ENVELOPE GENERATOR — GHPython Component
================================================
Paste this into a GHPython component in Grasshopper.

INPUTS (right-click component → Manage Inputs):
  siteWidth        float   Site width in metres (X direction)
  siteDepth        float   Site depth in metres (Y direction)
  zoneMaxHeight    float   Maximum building height (m)
  zoneMaxFSR       float   Maximum floor space ratio
  zoneFrontSetback float   Front setback (m) — south edge (Y=0)
  zoneSideSetback  float   Side setback (m) — east/west edges
  zoneRearSetback  float   Rear setback (m) — north edge (Y=max)
  zoneMaxCoverage  float   Maximum site coverage (%)
  floor_height     float   Typical floor-to-floor height (m)

OUTPUTS (right-click component → Manage Outputs):
  out                string    Summary text (connect to Panel)
  siteBoundary       Curve     Site boundary rectangle
  buildableFootprint Curve     Buildable area after setbacks
  zoningEnvelope     Brep      3D zoning envelope (extruded)
  setbackLines       Curve[]   Individual setback offset lines
  siteArea           float     Total site area (m2)
  buildableArea      float     Buildable footprint area (m2)
  maxGFA             float     Max gross floor area (m2)
  maxFloors          int       Max floors within height limit
  envelopeVolume     float     Zoning envelope volume (m3)
  export_json        string    JSON bundle of all zoning data (connect to gh-params-export)
"""

import Rhino.Geometry as rg
import math
import json

# ── Safe coercion ─────────────────────────────────────────
def sf(val, default):
    if val is None or str(val) == "None":
        return default
    try:
        return float(val)
    except:
        return default

# ── Defaults ──────────────────────────────────────────────
siteWidth       = sf(siteWidth, 30.0)
siteDepth       = sf(siteDepth, 40.0)
zoneMaxHeight   = sf(zoneMaxHeight, 36.0)
zoneMaxFSR      = sf(zoneMaxFSR, 3.0)
zoneFrontSetback = sf(zoneFrontSetback, 0.0)
zoneSideSetback  = sf(zoneSideSetback, 0.0)
zoneRearSetback  = sf(zoneRearSetback, 0.0)
zoneMaxCoverage  = sf(zoneMaxCoverage, 100.0)
floor_height     = sf(floor_height, 3.6)

# ── Helper: join 4 lines into a closed PolyCurve ─────────
# PolyCurve (joined segments) is what Rhino rectangles produce.
# Downstream scripts rely on DuplicateSegments() returning 4 edges
# and Extrusion.Create() needs a proper closed planar curve.
def make_rect(a, b, c, d):
    segs = [
        rg.LineCurve(a, b),
        rg.LineCurve(b, c),
        rg.LineCurve(c, d),
        rg.LineCurve(d, a)
    ]
    joined = rg.Curve.JoinCurves(segs)
    if joined and len(joined) > 0:
        return joined[0]
    # Fallback
    return rg.Polyline([a, b, c, d, a]).ToNurbsCurve()

# ── Step 1: Site Boundary ─────────────────────────────────
# Rectangle at origin — front = south edge (Y=0)
p0 = rg.Point3d(0, 0, 0)
p1 = rg.Point3d(siteWidth, 0, 0)
p2 = rg.Point3d(siteWidth, siteDepth, 0)
p3 = rg.Point3d(0, siteDepth, 0)

siteBoundary = make_rect(p0, p1, p2, p3)
siteArea = siteWidth * siteDepth

# ── Step 2: Per-Edge Setback → Buildable Footprint ───────
# Front = south (Y=0) → offset inward = +Y
# Rear  = north (Y=siteDepth) → offset inward = -Y
# Left  = west  (X=0) → offset inward = +X
# Right = east  (X=siteWidth) → offset inward = -X

bx0 = zoneSideSetback              # left edge inward
bx1 = siteWidth - zoneSideSetback  # right edge inward
by0 = zoneFrontSetback             # front edge inward
by1 = siteDepth - zoneRearSetback  # rear edge inward

# Clamp to prevent negative/zero buildable area
bx0 = min(bx0, siteWidth / 2.0 - 0.1)
bx1 = max(bx1, siteWidth / 2.0 + 0.1)
by0 = min(by0, siteDepth / 2.0 - 0.1)
by1 = max(by1, siteDepth / 2.0 + 0.1)

bp0 = rg.Point3d(bx0, by0, 0)
bp1 = rg.Point3d(bx1, by0, 0)
bp2 = rg.Point3d(bx1, by1, 0)
bp3 = rg.Point3d(bx0, by1, 0)

buildableFootprint = make_rect(bp0, bp1, bp2, bp3)
buildableWidth = bx1 - bx0
buildableDepth = by1 - by0
buildableArea = buildableWidth * buildableDepth

# ── Step 3: Setback visualization lines ──────────────────
# Lines showing the setback offset from each site edge
setbackLines = []
if zoneFrontSetback > 0:
    setbackLines.append(rg.Line(rg.Point3d(0, by0, 0), rg.Point3d(siteWidth, by0, 0)).ToNurbsCurve())
if zoneRearSetback > 0:
    setbackLines.append(rg.Line(rg.Point3d(0, by1, 0), rg.Point3d(siteWidth, by1, 0)).ToNurbsCurve())
if zoneSideSetback > 0:
    setbackLines.append(rg.Line(rg.Point3d(bx0, 0, 0), rg.Point3d(bx0, siteDepth, 0)).ToNurbsCurve())
    setbackLines.append(rg.Line(rg.Point3d(bx1, 0, 0), rg.Point3d(bx1, siteDepth, 0)).ToNurbsCurve())

# ── Step 4: Calculate Metrics ────────────────────────────
maxFloors = int(math.floor(zoneMaxHeight / floor_height)) if floor_height > 0 else 0
maxGFA = siteArea * zoneMaxFSR

# ── Step 5: Apply Coverage + FSR limits to footprint ─────
# Coverage limit
maxFootprint_by_coverage = siteArea * (zoneMaxCoverage / 100.0)

# FSR limit: maxGFA / maxFloors = max footprint per floor
if maxFloors > 0:
    maxFootprint_by_FSR = maxGFA / maxFloors
else:
    maxFootprint_by_FSR = 0.0

# Effective footprint = smallest of setback area, coverage, FSR
effectiveFootprint = min(buildableArea, maxFootprint_by_coverage, maxFootprint_by_FSR)

# Determine which constraint is active
if effectiveFootprint >= buildableArea - 0.01:
    footprintLimitedBy = "Setback"
elif effectiveFootprint >= maxFootprint_by_coverage - 0.01:
    footprintLimitedBy = "Coverage"
else:
    footprintLimitedBy = "FSR"

# If coverage or FSR shrinks the footprint, scale the buildable rect inward
if effectiveFootprint < buildableArea - 0.01:
    _scale = math.sqrt(effectiveFootprint / buildableArea)
    _cx = (bx0 + bx1) / 2.0
    _cy = (by0 + by1) / 2.0
    _hw = buildableWidth / 2.0 * _scale
    _hd = buildableDepth / 2.0 * _scale
    fp0 = rg.Point3d(_cx - _hw, _cy - _hd, 0)
    fp1 = rg.Point3d(_cx + _hw, _cy - _hd, 0)
    fp2 = rg.Point3d(_cx + _hw, _cy + _hd, 0)
    fp3 = rg.Point3d(_cx - _hw, _cy + _hd, 0)
    buildableFootprint = make_rect(fp0, fp1, fp2, fp3)
    buildableWidth = _hw * 2
    buildableDepth = _hd * 2
    buildableArea = effectiveFootprint

# ── Step 6: Extrude to Zoning Envelope ───────────────────
_ebb = buildableFootprint.GetBoundingBox(True)
_ex0, _ey0 = _ebb.Min.X, _ebb.Min.Y
_ex1, _ey1 = _ebb.Max.X, _ebb.Max.Y

# Use simple box from buildable footprint bounding box (most reliable)
box = rg.Box(
    rg.Plane.WorldXY,
    rg.Interval(_ex0, _ex1),
    rg.Interval(_ey0, _ey1),
    rg.Interval(0, zoneMaxHeight)
)
zoningEnvelope = rg.Brep.CreateFromBox(box)
envelopeVolume = buildableArea * zoneMaxHeight

print("DEBUG envelope: footprint BB = ({:.1f},{:.1f}) to ({:.1f},{:.1f}), h={:.1f}".format(
    _ex0, _ey0, _ex1, _ey1, zoneMaxHeight))

# ── Summary Output ───────────────────────────────────────
print("ZONING ENVELOPE")
print("Site: {} x {} m = {:.1f} m2".format(siteWidth, siteDepth, siteArea))
print("Setbacks F/S/R: {}/{}/{} m".format(zoneFrontSetback, zoneSideSetback, zoneRearSetback))
print("Buildable: {:.1f} x {:.1f} m = {:.1f} m2 (limited by {})".format(
    buildableWidth, buildableDepth, buildableArea, footprintLimitedBy))
print("Max Height: {:.1f} m | Max Floors: {} @ {:.1f} m".format(zoneMaxHeight, maxFloors, floor_height))
print("Max FSR: {} → Max GFA: {:.1f} m2 → Max Footprint/floor: {:.1f} m2".format(
    zoneMaxFSR, maxGFA, maxFootprint_by_FSR))
print("Max Coverage: {:.0f}% → Max Footprint: {:.1f} m2".format(zoneMaxCoverage, maxFootprint_by_coverage))
print("Envelope Vol: {:.1f} m3".format(envelopeVolume))

# ── Export JSON bundle (connect to gh-params-export zoning input) ─
export_json = json.dumps({
    "siteWidth": float(siteWidth),
    "siteDepth": float(siteDepth),
    "zoneMaxHeight": float(zoneMaxHeight),
    "zoneMaxFSR": float(zoneMaxFSR),
    "zoneFrontSetback": float(zoneFrontSetback),
    "zoneSideSetback": float(zoneSideSetback),
    "zoneRearSetback": float(zoneRearSetback),
    "zoneMaxCoverage": float(zoneMaxCoverage),
    "floorHeight": float(floor_height),
    "siteArea": round(siteArea, 2),
    "buildableArea": round(buildableArea, 2),
    "maxGFA": round(maxGFA, 2),
    "maxFloors": maxFloors,
    "maxFootprintByFSR": round(maxFootprint_by_FSR, 2),
    "maxFootprintByCoverage": round(maxFootprint_by_coverage, 2),
    "effectiveFootprint": round(effectiveFootprint, 2),
    "footprintLimitedBy": footprintLimitedBy,
    "envelopeVolume": round(envelopeVolume, 2)
})
# ---------- end gh_zoning_envelope ----------
gh_massing = Python3Script(
    site_boundary=gh_zoning_envelope.siteBoundary,
    base_curve=gh_zoning_envelope.buildableFootprint,
    base_shape=python_3_script.base_shape,
    base_scale=python_3_script.base_scale,
    top_scale=python_3_script.top_scale,
    top_offset_x=python_3_script.top_offset_x,
    top_offset_y=python_3_script.top_offset_y,
    top_rotation=python_3_script.top_rotation,
    floors=python_3_script.floors,
    floor_height=python_3_script.floor_height,
    orientation=python_3_script.orientation,
    section_type=python_3_script.section_type,
    podium_floors=python_3_script.podium_floors,
    tower_ratio=python_3_script.tower_ratio,
    setback_depth=python_3_script.setback_depth,
    setback_interval=python_3_script.setback_interval,
    stilt_floors=python_3_script.stilt_floors,
    stilt_col_span=python_3_script.structural_span,
    stilt_col_shape=python_3_script.stilt_col_shape,
    stilt_col_size=python_3_script.stilt_col_size,
    lateral_system=python_3_script.lateral_system,
    garden_interval=python_3_script.garden_interval,
    garden_floors=python_3_script.garden_floors,
    plan_type=python_3_script.plan_type,
    courtyard_ratio=python_3_script.courtyard_ratio,
    void_corner=python_3_script.void_corner,
    void_ratio=python_3_script.void_ratio,
    split_gap=python_3_script.split_gap,
    bar_ratio=python_3_script.bar_ratio)  # -> out, floor_slabs, building_mass, stilt_columns, floor_curves, massing_area, massing_volume, efficiency, export_json; inputs base_curve: Curve
# ---------- gh_massing: Python ----------
# ArchSim Massing Generator V2 — Two-Curve System
# ─────────────────────────────────────────────────────────────────────────────
# Generates parametric building massing from base + top curves.
# Section modifiers control vertical stacking.
# Plan modifiers control floor plate shape.
# Combinable: 5 section x 5 plan = 25 possible combinations.
#
# Inspired by EvoMass (Likai Wang, NUS/XJTLU) subtractive/additive approach.
#
# INPUTS:
#   base_curve       Curve   — Bottom footprint (from zoning buildableFootprint)
#   top_curve        Curve   — Top footprint (optional, auto-generated if None)
#   site_boundary    Curve   — Site/buildable boundary for clipping (optional)
#   floors           Integer — Number of floors
#   floor_height     Number  — Floor-to-floor height (m)
#   orientation      Number  — Rotation angle in degrees (0 = North)
#
#   # Base shape (footprint derived from base_curve bounding box):
#   base_shape       Integer — 0=Rectangle (use base_curve as-is)
#                               1=Ellipse  2=Circle  3=Chamfered
#                               4=Diamond  5=H-Shape  6=Cross (+)
#   base_scale       Number  — Scale of footprint within base_curve (0.3-1.0, default 1.0)
#
#   # Top curve params (used when top_curve is not connected):
#   top_scale        Number  — Scale of top vs base (0.1-1.0, default 1.0)
#   top_offset_x     Number  — Shift top east/west in metres (default 0)
#   top_offset_y     Number  — Shift top north/south in metres (default 0)
#   top_rotation     Number  — Twist top vs base in degrees (default 0)
#
#   # Section modifier (how floors stack vertically):
#   section_type     Integer — 0=Straight  1=Podium+Tower  2=Stepped
#                               3=Stilt/Piloti  4=Sky Garden
#
#   # Plan modifier (floor plate shape):
#   plan_type        Integer — 0=Solid
#                               1=Courtyard (Both)  2=Courtyard (Tower Only)
#                               3=Courtyard (Podium Only)
#                               4=L-Shape  5=U-Shape  6=Split/Dual Bar
#
#   # Section params:
#   podium_floors    Integer — Podium height in floors (section 1, default 3)
#   tower_ratio      Number  — Tower footprint ratio of base (section 1, 0.2-0.9, default 0.5)
#   setback_depth    Number  — Setback depth per step in m (section 2, default 2.0)
#   setback_interval Integer — Step every N floors (section 2, default 5)
#   stilt_floors     Integer — Open ground floors (section 3, default 2)
#   stilt_col_span   Number  — Column spacing in stilt zone m (default 8, matches structural_span)
#   stilt_col_shape  Integer — Column shape: 0=Square  1=Round (default 0)
#   stilt_col_size   Number  — Column width/diameter in m (default 0.8)
#   lateral_system   Integer — 0=RC Core 1=Perimeter 2=Moment 3=Reserved (default 0)
#   garden_interval  Integer — Sky garden every N floors (section 4, default 6)
#   garden_floors    Integer — Sky garden floor count (section 4, default 1)
#
#   # Plan params:
#   courtyard_ratio  Number  — Courtyard void ratio (plan 1-3, 0.05-0.6, default 0.25)
#   void_corner      Integer — Corner to void (plan 4, 0=NE 1=NW 2=SW 3=SE, default 0)
#   void_ratio       Number  — Void size ratio (plan 4/5, 0.2-0.6, default 0.4)
#   split_gap        Number  — Gap between bars in m (plan 6, default 4.0)
#   bar_ratio        Number  — Width ratio per bar (plan 6, 0.15-0.45, default 0.4)
#
# OUTPUTS:
#   floor_slabs      List of Brep   — Floor slab surfaces per level
#   building_mass    List of Brep   — Building solid(s)
#   stilt_columns    List of Brep   — Stilt/sky garden column breps (separate output)
#   floor_curves     List of Curve  — Floor plate curves at each level
#   massing_area     Number         — Total gross floor area
#   massing_volume   Number         — Building volume
#   efficiency       Number         — Floor area ratio vs base case (1.0 = no loss)
#   export_json      String         — JSON bundle (connect to gh-params-export)
#   out              String         — Summary
# ─────────────────────────────────────────────────────────────────────────────

import Rhino.Geometry as rg
import math
import json
import System
import os, sys

# ── Import massing_helpers ─────────────────────────────────────────────────
# Add mcp directory to path so massing_helpers can be imported.
try:
    _ghdoc = ghenv.Component.OnPingDocument()
    _ghpath = _ghdoc.FilePath if _ghdoc else ""
    if _ghpath:
        _mcp = os.path.normpath(os.path.join(os.path.dirname(_ghpath),
               "app", "ClaudeCode", "Claude_Project_ArchSimV2", "mcp"))
        if os.path.isdir(_mcp) and _mcp not in sys.path:
            sys.path.insert(0, _mcp)
except:
    pass
try:
    _self_dir = os.path.dirname(os.path.abspath(__file__))
    if _self_dir not in sys.path:
        sys.path.insert(0, _self_dir)
except:
    pass

# Force reload during development
if "massing_helpers" in sys.modules:
    del sys.modules["massing_helpers"]
import massing_helpers as mh

# ── Validate & coerce required inputs ───────────────────────────────────────
if base_curve is None:
    raise Exception("Connect base_curve (buildableFootprint from zoning envelope).")
if not hasattr(base_curve, "DuplicateCurve"):
    if hasattr(base_curve, "Geometry"):
        base_curve = base_curve.Geometry
    else:
        import rhinoscriptsyntax as rs
        base_curve = rs.coercecurve(base_curve)
        if base_curve is None:
            raise Exception("base_curve: cannot coerce input to Curve")
if floors is None or floors < 1:
    raise Exception("floors must be >= 1")
if floor_height is None or floor_height <= 0:
    raise Exception("floor_height must be > 0")

# ── Safe param readers ──────────────────────────────────────────────────────
def safe_int(val, default):
    if val is None or str(val) == "None":
        return default
    try:
        return int(val)
    except:
        return default

def safe_float(val, default):
    if val is None or str(val) == "None":
        return default
    try:
        return float(val)
    except:
        return default

# ── Parse all inputs ────────────────────────────────────────────────────────
nf   = int(floors)
fh   = float(floor_height)
ori  = safe_float(orientation, 0.0)
height = nf * fh

# Top curve params
p_top_scale    = max(0.1, min(1.0, safe_float(top_scale, 1.0)))
p_top_offset_x = safe_float(top_offset_x, 0.0)
p_top_offset_y = safe_float(top_offset_y, 0.0)
p_top_rotation = safe_float(top_rotation, 0.0)

# Base shape
b_shape = safe_int(base_shape, 0)
b_scale = max(0.3, min(1.0, safe_float(base_scale, 1.0)))

# Section + plan type
s_type = safe_int(section_type, 0)
p_type = safe_int(plan_type, 0)

# Section params
p_podium_floors    = safe_int(podium_floors, 3)
p_tower_ratio      = safe_float(tower_ratio, 0.5)
p_setback_depth    = safe_float(setback_depth, 2.0)
p_setback_interval = safe_int(setback_interval, 5)
p_stilt_floors     = safe_int(stilt_floors, 2)
p_stilt_col_span   = safe_float(stilt_col_span, 8.0)
p_stilt_col_shape  = safe_int(stilt_col_shape, 0)    # 0=Square, 1=Round
p_stilt_col_size   = max(0.2, min(3.0, safe_float(stilt_col_size, 0.8)))
p_lateral_system   = safe_int(lateral_system, 0)
p_garden_interval  = safe_int(garden_interval, 6)
p_garden_floors    = safe_int(garden_floors, 1)

# Plan params
p_courtyard_ratio = safe_float(courtyard_ratio, 0.25)
p_void_corner     = safe_int(void_corner, 0)
p_void_ratio      = safe_float(void_ratio, 0.4)
p_split_gap       = safe_float(split_gap, 4.0)
p_bar_ratio       = safe_float(bar_ratio, 0.4)

SECTION_NAMES = ["Straight", "Podium + Tower", "Stepped", "Stilt / Piloti", "Sky Garden"]
PLAN_NAMES    = ["Solid", "Courtyard", "Courtyard (Tower)", "Courtyard (Podium)",
                 "L-Shape", "U-Shape", "Split / Dual Bar"]
COURTYARD_ZONE_NAMES = ["Both", "Tower Only", "Podium Only"]

# Plan type helper flags
_is_courtyard = p_type in (1, 2, 3)
_courtyard_zone = p_type - 1 if _is_courtyard else -1
BASE_SHAPE_NAMES = ["Rectangle", "Ellipse", "Circle", "Chamfered", "Diamond", "H-Shape", "Cross"]

# ── Base footprint info ─────────────────────────────────────────────────────
bb, bb_min, bb_max = mh.get_bb(base_curve)
base_W = bb_max.X - bb_min.X
base_D = bb_max.Y - bb_min.Y
x0 = bb_min.X
y0 = bb_min.Y
centroid = mh.get_centroid(base_curve)

# ── Generate base shape from bounding box ──────────────────────────────────
if b_shape > 0:
    cx, cy = centroid.X, centroid.Y
    hw = base_W / 2.0 * b_scale
    hd = base_D / 2.0 * b_scale

    if b_shape == 1:
        el = rg.Ellipse(rg.Plane(rg.Point3d(cx, cy, 0), rg.Vector3d.ZAxis), hw, hd)
        base_curve = el.ToNurbsCurve()
    elif b_shape == 2:
        r = min(hw, hd)
        circle = rg.Circle(rg.Plane(rg.Point3d(cx, cy, 0), rg.Vector3d.ZAxis), r)
        base_curve = circle.ToNurbsCurve()
    elif b_shape == 3:
        ch = min(hw, hd) * 0.3
        pts = [
            rg.Point3d(cx - hw + ch, cy - hd, 0), rg.Point3d(cx + hw - ch, cy - hd, 0),
            rg.Point3d(cx + hw, cy - hd + ch, 0), rg.Point3d(cx + hw, cy + hd - ch, 0),
            rg.Point3d(cx + hw - ch, cy + hd, 0), rg.Point3d(cx - hw + ch, cy + hd, 0),
            rg.Point3d(cx - hw, cy + hd - ch, 0), rg.Point3d(cx - hw, cy - hd + ch, 0),
        ]
        pts.append(pts[0])
        base_curve = rg.PolylineCurve([rg.Point3d(p.X, p.Y, p.Z) for p in pts])
    elif b_shape == 4:
        pts = [
            rg.Point3d(cx, cy - hd, 0), rg.Point3d(cx + hw, cy, 0),
            rg.Point3d(cx, cy + hd, 0), rg.Point3d(cx - hw, cy, 0),
        ]
        pts.append(pts[0])
        base_curve = rg.PolylineCurve([rg.Point3d(p.X, p.Y, p.Z) for p in pts])
    elif b_shape == 5:
        fw = hw * 0.35
        wh = hd * 0.35
        pts = [
            rg.Point3d(cx - hw, cy - hd, 0), rg.Point3d(cx - hw + fw, cy - hd, 0),
            rg.Point3d(cx - hw + fw, cy - wh, 0), rg.Point3d(cx + hw - fw, cy - wh, 0),
            rg.Point3d(cx + hw - fw, cy - hd, 0), rg.Point3d(cx + hw, cy - hd, 0),
            rg.Point3d(cx + hw, cy + hd, 0), rg.Point3d(cx + hw - fw, cy + hd, 0),
            rg.Point3d(cx + hw - fw, cy + wh, 0), rg.Point3d(cx - hw + fw, cy + wh, 0),
            rg.Point3d(cx - hw + fw, cy + hd, 0), rg.Point3d(cx - hw, cy + hd, 0),
        ]
        pts.append(pts[0])
        base_curve = rg.PolylineCurve([rg.Point3d(p.X, p.Y, p.Z) for p in pts])
    elif b_shape == 6:
        aw = hw * 0.4
        ad = hd * 0.4
        pts = [
            rg.Point3d(cx - aw, cy - hd, 0), rg.Point3d(cx + aw, cy - hd, 0),
            rg.Point3d(cx + aw, cy - ad, 0), rg.Point3d(cx + hw, cy - ad, 0),
            rg.Point3d(cx + hw, cy + ad, 0), rg.Point3d(cx + aw, cy + ad, 0),
            rg.Point3d(cx + aw, cy + hd, 0), rg.Point3d(cx - aw, cy + hd, 0),
            rg.Point3d(cx - aw, cy + ad, 0), rg.Point3d(cx - hw, cy + ad, 0),
            rg.Point3d(cx - hw, cy - ad, 0), rg.Point3d(cx - aw, cy - ad, 0),
        ]
        pts.append(pts[0])
        base_curve = rg.PolylineCurve([rg.Point3d(p.X, p.Y, p.Z) for p in pts])

elif b_scale < 0.999:
    base_curve = mh.scale_curve(base_curve, b_scale, centroid)

# Recompute after shape generation
centroid = mh.get_centroid(base_curve)
base_area = mh.get_area(base_curve)
if base_area == 0:
    bb2 = base_curve.GetBoundingBox(True)
    base_area = (bb2.Max.X - bb2.Min.X) * (bb2.Max.Y - bb2.Min.Y)

# ── Coerce top_curve if provided ────────────────────────────────────────────
has_top_curve = top_curve is not None
_top_crv_input = None
if has_top_curve:
    if hasattr(top_curve, "DuplicateCurve"):
        _top_crv_input = top_curve
    elif hasattr(top_curve, "Geometry"):
        _top_crv_input = top_curve.Geometry
    else:
        import rhinoscriptsyntax as rs
        _top_crv_input = rs.coercecurve(top_curve)
        if _top_crv_input is None:
            raise Exception("top_curve: cannot coerce input to Curve (got {})".format(type(top_curve)))

# ══════════════════════════════════════════════════════════════════════════════
# STEP 0: APPLY ORIENTATION + FIT TO SITE BOUNDARY
# ══════════════════════════════════════════════════════════════════════════════

_site_bnd = None
if site_boundary is not None:
    if hasattr(site_boundary, "DuplicateCurve"):
        _site_bnd = site_boundary
    elif hasattr(site_boundary, "Geometry"):
        _site_bnd = site_boundary.Geometry
    else:
        import rhinoscriptsyntax as rs
        _site_bnd = rs.coercecurve(site_boundary)

if abs(ori) > 0.001:
    base_curve = mh.rotate_curve(base_curve, ori, centroid)

_fit_scale = 1.0
if _site_bnd is not None and _site_bnd.IsClosed:
    def calc_fit_scale(crv, bnd, center):
        tol = 0.01
        n_samples = 64
        min_ratio = 1.0
        any_outside = False
        for i in range(n_samples):
            t = crv.Domain.ParameterAt(i / float(n_samples))
            pt = crv.PointAt(t)
            if bnd.Contains(pt, rg.Plane.WorldXY, tol) == rg.PointContainment.Outside:
                any_outside = True
                dx = pt.X - center.X
                dy = pt.Y - center.Y
                dist_pt = (dx*dx + dy*dy) ** 0.5
                if dist_pt < 0.001:
                    continue
                ray_line = rg.LineCurve(
                    rg.Point3d(center.X, center.Y, 0),
                    rg.Point3d(center.X + dx * 10, center.Y + dy * 10, 0))
                ix_events = rg.Intersect.Intersection.CurveCurve(ray_line, bnd, tol, tol)
                if ix_events:
                    for ev in ix_events:
                        bnd_pt = ev.PointA
                        dist_bnd = ((bnd_pt.X - center.X)**2 + (bnd_pt.Y - center.Y)**2) ** 0.5
                        if dist_bnd > 0.001:
                            ratio = dist_bnd / dist_pt
                            if ratio < min_ratio:
                                min_ratio = ratio
        if not any_outside:
            return 1.0
        return max(0.1, min_ratio * 0.98)

    _fit_scale = calc_fit_scale(base_curve, _site_bnd, centroid)
    if _fit_scale < 0.999:
        base_curve = mh.scale_curve(base_curve, _fit_scale, centroid)

# ── Resolve top curve ──────────────────────────────────────────────────────
fitted_centroid = mh.get_centroid(base_curve)
if has_top_curve:
    _top_crv = _top_crv_input
    if abs(ori) > 0.001:
        _top_crv = mh.rotate_curve(_top_crv, ori, centroid)
    if _fit_scale < 0.999:
        _top_crv = mh.scale_curve(_top_crv, _fit_scale, centroid)
else:
    _top_crv = base_curve.DuplicateCurve()

if p_top_scale != 1.0:
    _top_crv = mh.scale_curve(_top_crv, p_top_scale, fitted_centroid)
if p_top_offset_x != 0 or p_top_offset_y != 0:
    _top_crv = mh.offset_curve(_top_crv, p_top_offset_x, p_top_offset_y)

# Recompute from fitted base
bb, bb_min, bb_max = mh.get_bb(base_curve)
base_W = bb_max.X - bb_min.X
base_D = bb_max.Y - bb_min.Y
x0 = bb_min.X
y0 = bb_min.Y
centroid = mh.get_centroid(base_curve)
base_area = mh.get_area(base_curve)
if base_area == 0:
    base_area = base_W * base_D

# ══════════════════════════════════════════════════════════════════════════════
# STEP 1: INTERPOLATE BASE → TOP for each floor (section-aware)
# ══════════════════════════════════════════════════════════════════════════════
void_floors = set()
step_count = 0

def _interp(floor_idx):
    return mh.interpolate_curve(floor_idx, base_curve, _top_crv, nf)

envelope_curves = []

if s_type == 0:
    for i in range(nf + 1):
        envelope_curves.append(_interp(i))

elif s_type == 1:
    p_podium_floors = max(1, min(p_podium_floors, nf - 1))
    p_tower_ratio = max(0.2, min(p_tower_ratio, 0.9))
    for i in range(nf + 1):
        if i <= p_podium_floors:
            envelope_curves.append(_interp(i))
        else:
            interp = _interp(i)
            c = mh.get_centroid(interp)
            envelope_curves.append(mh.scale_curve(interp, p_tower_ratio, c))

elif s_type == 2:
    p_setback_interval = max(2, p_setback_interval)
    p_setback_depth = max(0.5, p_setback_depth)
    current_offset = 0.0
    for i in range(nf + 1):
        step_idx = i // p_setback_interval if i > 0 else 0
        current_offset = step_idx * p_setback_depth
        if step_idx > 0:
            step_count = step_idx
        step_base_floor = step_idx * p_setback_interval
        step_crv = _interp(step_base_floor)
        if current_offset > 0:
            step_crv = mh.offset_rect_inward(step_crv, current_offset)
        envelope_curves.append(step_crv)

elif s_type == 3:
    p_stilt_floors = max(1, min(p_stilt_floors, nf - 1))
    for i in range(nf + 1):
        envelope_curves.append(_interp(i))
    for i in range(0, p_stilt_floors):
        void_floors.add(i)

elif s_type == 4:
    p_garden_interval = max(3, p_garden_interval)
    p_garden_floors = max(1, min(p_garden_floors, p_garden_interval - 1))
    for i in range(nf + 1):
        envelope_curves.append(_interp(i))
    for i in range(1, nf + 1):
        if i % p_garden_interval == 0:
            for g in range(p_garden_floors):
                if i + g < nf:
                    void_floors.add(i + g)

else:
    s_type = 0
    for i in range(nf + 1):
        envelope_curves.append(_interp(i))

# Save unrotated envelope
_env_no_twist = [crv.DuplicateCurve() for crv in envelope_curves]

# Apply per-floor twist
_has_twist = abs(p_top_rotation) > 0.001 and not has_top_curve
if _has_twist:
    for i in range(len(envelope_curves)):
        t = float(i) / max(1, nf)
        angle = t * p_top_rotation
        if abs(angle) > 0.001:
            c_i = mh.get_centroid(envelope_curves[i])
            rad = math.radians(angle)
            xf = rg.Transform.Rotation(math.sin(rad), math.cos(rad),
                                        rg.Vector3d.ZAxis, c_i)
            envelope_curves[i].Transform(xf)

# ══════════════════════════════════════════════════════════════════════════════
# STEP 2: BUILD FLOOR CURVES
# ══════════════════════════════════════════════════════════════════════════════
curves_out = []

p_courtyard_ratio = max(0.05, min(p_courtyard_ratio, 0.6))
p_void_corner = max(0, min(p_void_corner, 3))
p_void_ratio = max(0.2, min(p_void_ratio, 0.6))
p_bar_ratio = max(0.15, min(p_bar_ratio, 0.45))
p_split_gap = max(1.0, p_split_gap)
p_courtyard_zone = _courtyard_zone

for i in range(nf + 1):
    curves_out.append(mh.move_curve_z(envelope_curves[i], i * fh))

# ══════════════════════════════════════════════════════════════════════════════
# STEP 3: GENERATE FLOOR SLABS (with plan voids applied)
# ══════════════════════════════════════════════════════════════════════════════
slabs_out = mh.generate_floor_slabs(
    nf, fh, void_floors, curves_out, envelope_curves,
    p_type, s_type, p_podium_floors,
    p_courtyard_ratio, p_void_corner, p_void_ratio,
    p_split_gap, p_bar_ratio,
    _is_courtyard, _courtyard_zone,
    _has_twist, p_top_rotation)

# ── Void cap slabs (sky garden / stilt) ────────────────────────────────────
slabs_out.extend(mh.generate_void_cap_slabs(
    void_floors, s_type, nf, fh, curves_out, envelope_curves,
    p_type, p_courtyard_ratio, p_void_corner, p_void_ratio,
    p_split_gap, p_bar_ratio,
    _is_courtyard, _has_twist, p_top_rotation))

# ── Step/podium transition cap slabs ──────────────────────────────────────
slabs_out.extend(mh.generate_step_cap_slabs(
    s_type, p_type, nf, fh, void_floors,
    envelope_curves, curves_out,
    p_courtyard_ratio, p_void_corner, p_void_ratio,
    p_split_gap, p_bar_ratio,
    _has_twist, p_top_rotation))

# ══════════════════════════════════════════════════════════════════════════════
# STEP 4: GENERATE BUILDING MASS
# ══════════════════════════════════════════════════════════════════════════════
mass_parts = []

def _range_has_courtyard(f_bot, f_top):
    if not _is_courtyard:
        return False
    if s_type != 1:
        return True
    is_tower_range = f_bot >= p_podium_floors
    is_podium_range = f_top <= p_podium_floors
    if _courtyard_zone == 0:
        return True
    elif _courtyard_zone == 1:
        return is_tower_range
    elif _courtyard_zone == 2:
        return is_podium_range
    return True

def get_section_ranges():
    if s_type == 1:
        ranges = []
        if p_podium_floors > 0:
            ranges.append((0, p_podium_floors, 0))
        if p_podium_floors < nf:
            ranges.append((p_podium_floors, nf, p_podium_floors + 1))
        return ranges
    elif s_type == 2:
        ranges = []
        boundaries = [0]
        for i in range(1, nf + 1):
            if i % p_setback_interval == 0:
                boundaries.append(i)
        if boundaries[-1] != nf:
            boundaries.append(nf)
        for si in range(len(boundaries) - 1):
            fb = boundaries[si]
            ft = boundaries[si + 1]
            ranges.append((fb, ft, fb))
        return ranges
    elif s_type == 3:
        if p_stilt_floors < nf:
            return [(p_stilt_floors, nf, p_stilt_floors)]
        return []
    elif s_type == 4:
        ranges = []
        sorted_voids = sorted(void_floors)
        start = 0
        for vf in sorted_voids:
            if vf > start:
                ranges.append((start, vf, start))
            start = vf + 1
        if start <= nf:
            ranges.append((start, nf, start))
        return ranges if ranges else [(0, nf, 0)]
    else:
        return [(0, nf, 0)]

_section_ranges = get_section_ranges()
_flat_transition = s_type in (1, 2)
print("DEBUG mass gen: ranges={}, twist={}, plan={}".format(_section_ranges, _has_twist, p_type))

for (f_bot, f_top, crv_idx) in _section_ranges:
    if f_top <= f_bot:
        continue
    z_bot = f_bot * fh
    z_top = f_top * fh
    range_h = z_top - z_bot
    if range_h <= 0:
        continue

    m = None

    def _get_floor_crv(fi):
        if _flat_transition:
            crv = _env_no_twist[crv_idx].DuplicateCurve()
            if _has_twist:
                t = float(fi) / max(1, nf)
                angle = t * p_top_rotation
                if abs(angle) > 0.001:
                    ct = mh.get_centroid(crv)
                    rad = math.radians(angle)
                    xf = rg.Transform.Rotation(math.sin(rad), math.cos(rad),
                                                rg.Vector3d.ZAxis, ct)
                    crv.Transform(xf)
            return crv
        else:
            return envelope_curves[fi].DuplicateCurve()

    if _range_has_courtyard(f_bot, f_top):
        outer_crvs = []
        inner_crvs = []
        for fi in range(f_bot, f_top + 1):
            outer_fi = _get_floor_crv(fi)
            outer_crvs.append(mh.move_curve_z(outer_fi, fi * fh))
            c_fi = mh.get_centroid(outer_fi)
            inner_fi = mh.scale_curve(outer_fi, math.sqrt(p_courtyard_ratio), c_fi)
            inner_crvs.append(mh.move_curve_z(inner_fi, fi * fh))
        if len(outer_crvs) >= 2:
            m = mh.build_ring_mass(outer_crvs, inner_crvs)
        if not m:
            if _has_twist and len(outer_crvs) >= 2:
                m = mh.loft_curves(outer_crvs)
            else:
                crv_z = mh.move_curve_z(envelope_curves[crv_idx].DuplicateCurve(), z_bot)
                m = mh.extrude_curve_z(crv_z, range_h)
        print("  F{}-F{}: courtyard ring -> {}".format(
            f_bot, f_top, "OK solid={}".format(m.IsSolid) if m else "FAIL"))

    elif p_type >= 4:
        base_env_untw = _env_no_twist[crv_idx].DuplicateCurve()
        _be_bb, _be_mn, _be_mx = mh.get_bb(base_env_untw)
        _be_w = _be_mx.X - _be_mn.X
        _be_d = _be_mx.Y - _be_mn.Y
        _be_c = mh.get_centroid(base_env_untw)
        base_void_crv = None
        if p_type == 4:
            _vw = _be_w * p_void_ratio
            _vd = _be_d * p_void_ratio
            if p_void_corner == 0:
                _vx, _vy = _be_mx.X - _vw / 2.0, _be_mx.Y - _vd / 2.0
            elif p_void_corner == 1:
                _vx, _vy = _be_mn.X + _vw / 2.0, _be_mx.Y - _vd / 2.0
            elif p_void_corner == 2:
                _vx, _vy = _be_mn.X + _vw / 2.0, _be_mn.Y + _vd / 2.0
            else:
                _vx, _vy = _be_mx.X - _vw / 2.0, _be_mn.Y + _vd / 2.0
            base_void_crv = mh.make_rect_curve(_vx, _vy, _vw, _vd, 0)
        elif p_type == 5:
            _vw = _be_w * p_void_ratio
            _vd = _be_d * p_void_ratio
            base_void_crv = mh.make_rect_curve(_be_c.X, _be_mx.Y - _vd / 2.0, _vw, _vd, 0)
        elif p_type == 6:
            _vgap = min(p_split_gap, _be_w - _be_w * p_bar_ratio * 2)
            if _vgap < 1.0:
                _vgap = 1.0
            base_void_crv = mh.make_rect_curve(_be_c.X, _be_c.Y, _vgap, _be_d + 2, 0)

        base_pieces = mh.apply_void_2d(base_env_untw, base_void_crv)
        print("  F{}-F{}: L/U/split 2D boolean -> {} pieces (once on untwisted)".format(
            f_bot, f_top, len(base_pieces)))

        if len(base_pieces) > 1 or (len(base_pieces) == 1 and base_void_crv is not None):
            for pi_idx, base_piece in enumerate(base_pieces):
                loft_crvs = []
                for fi in range(f_bot, f_top + 1):
                    pc = base_piece.DuplicateCurve()
                    pc_c = mh.get_centroid(pc)
                    if not _flat_transition:
                        fi_env = _env_no_twist[fi]
                        fi_bb = fi_env.GetBoundingBox(True)
                        fi_w = fi_bb.Max.X - fi_bb.Min.X
                        fi_d = fi_bb.Max.Y - fi_bb.Min.Y
                        sx = fi_w / _be_w if _be_w > 0.001 else 1.0
                        sy = fi_d / _be_d if _be_d > 0.001 else 1.0
                        if abs(sx - 1.0) > 0.001 or abs(sy - 1.0) > 0.001:
                            xf_s = rg.Transform.Scale(rg.Plane(pc_c, rg.Vector3d.ZAxis), sx, sy, 1.0)
                            pc.Transform(xf_s)
                            fi_c = mh.get_centroid(fi_env)
                            new_c = mh.get_centroid(pc)
                            dx = fi_c.X - new_c.X
                            dy = fi_c.Y - new_c.Y
                            if abs(dx) > 0.001 or abs(dy) > 0.001:
                                pc.Translate(rg.Vector3d(dx, dy, 0))
                    if _has_twist:
                        t = float(fi) / max(1, nf)
                        angle = t * p_top_rotation
                        if abs(angle) > 0.001:
                            rad = math.radians(angle)
                            xf = rg.Transform.Rotation(math.sin(rad), math.cos(rad),
                                                        rg.Vector3d.ZAxis, _be_c)
                            pc.Transform(xf)
                    loft_crvs.append(mh.move_curve_z(pc, fi * fh))

                if len(loft_crvs) >= 2:
                    pm = mh.loft_curves(loft_crvs)
                    if pm:
                        mass_parts.append(pm)
                        print("    piece[{}]: loft {} crvs -> solid={}".format(
                            pi_idx, len(loft_crvs), pm.IsSolid))
                    else:
                        pm = mh.extrude_curve_z(loft_crvs[0], range_h)
                        if pm:
                            mass_parts.append(pm)
                            print("    piece[{}]: loft failed, extrude -> solid={}".format(
                                pi_idx, pm.IsSolid))
                        else:
                            print("    piece[{}]: all methods FAILED".format(pi_idx))
        else:
            crv_z = mh.move_curve_z(_env_no_twist[crv_idx].DuplicateCurve(), z_bot)
            m = mh.extrude_curve_z(crv_z, range_h)
            if m:
                mass_parts.append(m)
            print("  F{}-F{}: L/U/split boolean failed, solid fallback -> {}".format(
                f_bot, f_top, "OK" if m else "FAIL"))
        m = None

    elif _has_twist:
        loft_crvs = []
        for fi in range(f_bot, f_top + 1):
            loft_crvs.append(mh.move_curve_z(_get_floor_crv(fi), fi * fh))
        if len(loft_crvs) >= 2:
            m = mh.loft_curves(loft_crvs)
        print("  F{}-F{}: twist loft (flat={}) -> {} solid={}".format(
            f_bot, f_top, _flat_transition, "OK" if m else "FAIL",
            m.IsSolid if m else "n/a"))

    else:
        crv_z = mh.move_curve_z(envelope_curves[crv_idx].DuplicateCurve(), z_bot)
        m = mh.extrude_curve_z(crv_z, range_h)
        print("  F{}-F{}: extrude -> {} solid={}".format(
            f_bot, f_top, "OK" if m else "FAIL",
            m.IsSolid if m else "n/a"))

    if m:
        mass_parts.append(m)
print("DEBUG mass gen: {} parts".format(len(mass_parts)))

# ══════════════════════════════════════════════════════════════════════════════
# STEP 4b: COLUMNS (stilt / sky garden)
# ══════════════════════════════════════════════════════════════════════════════
_core_cx = centroid.X
_core_cy = centroid.Y
_core_cs = max(2.0, round(min(base_W, base_D) * 0.18, 2)) if p_lateral_system == 0 else 0
_core_hs = _core_cs / 2.0 + 0.3 if _core_cs > 0 else 0

_stilt_col_breps = []

_col_args = dict(
    envelope_curves=envelope_curves, nf=nf, fh=fh,
    p_stilt_col_size=p_stilt_col_size, p_stilt_col_shape=p_stilt_col_shape,
    b_shape=b_shape, p_type=p_type,
    p_courtyard_ratio=p_courtyard_ratio, p_void_corner=p_void_corner,
    p_void_ratio=p_void_ratio, p_split_gap=p_split_gap, p_bar_ratio=p_bar_ratio,
    has_twist=_has_twist, p_top_rotation=p_top_rotation,
    core_cx=_core_cx, core_cy=_core_cy, core_hs=_core_hs,
    env_no_twist=_env_no_twist, ori=ori)

if s_type == 3:
    _stilt_col_breps.extend(mh.add_columns(0, p_stilt_floors * fh, p_stilt_col_span, **_col_args))

if s_type == 4 and len(void_floors) > 0:
    sorted_voids = sorted(void_floors)
    void_start = sorted_voids[0]
    prev = sorted_voids[0]
    for vf in sorted_voids[1:]:
        if vf != prev + 1:
            _stilt_col_breps.extend(mh.add_columns(void_start * fh, (prev + 1 - void_start) * fh,
                                                    p_stilt_col_span, **_col_args))
            void_start = vf
        prev = vf
    _stilt_col_breps.extend(mh.add_columns(void_start * fh, (prev + 1 - void_start) * fh,
                                            p_stilt_col_span, **_col_args))

# Fallback mass
if len(mass_parts) == 0:
    try:
        ext = rg.Extrusion.Create(base_curve, height, True)
        if ext:
            mass_parts.append(ext.ToBrep(True))
    except:
        pass
if len(mass_parts) == 0:
    fb = rg.Brep.CreateFromBox(rg.Box(rg.Plane.WorldXY,
        rg.Interval(bb_min.X, bb_max.X), rg.Interval(bb_min.Y, bb_max.Y), rg.Interval(0, height)))
    if fb:
        mass_parts.append(fb)

# ══════════════════════════════════════════════════════════════════════════════
# STEP 5: COMPUTE METRICS
# ══════════════════════════════════════════════════════════════════════════════
total_area = 0.0
for slab in slabs_out:
    ap = rg.AreaMassProperties.Compute(slab)
    if ap:
        total_area += ap.Area

base_case_area = base_area * (nf + 1)
eff = total_area / base_case_area if base_case_area > 0 else 1.0

vol = 0.0
for part in mass_parts:
    vp = rg.VolumeMassProperties.Compute(part)
    if vp:
        vol += abs(vp.Volume)

# ── Outputs ──────────────────────────────────────────────────────────────────
floor_curves  = curves_out
floor_slabs   = slabs_out
building_mass = mass_parts
stilt_columns = _stilt_col_breps
massing_area   = round(total_area, 1)
massing_volume = round(vol, 1)
efficiency     = round(eff, 3)

# ── Summary ──────────────────────────────────────────────────────────────────
s_name = SECTION_NAMES[s_type] if s_type < len(SECTION_NAMES) else "Unknown"
p_name = PLAN_NAMES[p_type] if p_type < len(PLAN_NAMES) else "Unknown"

detail_parts = []
if has_top_curve:
    detail_parts.append("top_curve=connected")
else:
    if p_top_scale != 1.0:
        detail_parts.append("top_scale={:.0%}".format(p_top_scale))
    if p_top_offset_x != 0 or p_top_offset_y != 0:
        detail_parts.append("top_offset=({:.1f}, {:.1f})".format(p_top_offset_x, p_top_offset_y))
    if p_top_rotation != 0:
        detail_parts.append("top_rot={:.0f} deg".format(p_top_rotation))

if s_type == 1:
    detail_parts.append("podium={}F, tower_ratio={:.0%}".format(p_podium_floors, p_tower_ratio))
elif s_type == 2:
    detail_parts.append("step every {}F, depth={:.1f}m ({} steps)".format(p_setback_interval, p_setback_depth, step_count))
elif s_type == 3:
    detail_parts.append("stilt={}F ({:.1f}m open)".format(p_stilt_floors, p_stilt_floors * fh))
elif s_type == 4:
    detail_parts.append("garden every {}F, {}F open ({} voids)".format(p_garden_interval, p_garden_floors, len(void_floors)))

if _is_courtyard:
    cz_name = COURTYARD_ZONE_NAMES[_courtyard_zone] if 0 <= _courtyard_zone < len(COURTYARD_ZONE_NAMES) else "Both"
    zone_str = " zone={}".format(cz_name) if s_type == 1 and _courtyard_zone > 0 else ""
    detail_parts.append("courtyard={:.0%}{}".format(p_courtyard_ratio, zone_str))
elif p_type == 4:
    corner_names = ["NE", "NW", "SW", "SE"]
    detail_parts.append("L-void corner={}, ratio={:.0%}".format(corner_names[p_void_corner], p_void_ratio))
elif p_type == 5:
    detail_parts.append("U-void={:.0%}".format(p_void_ratio))
elif p_type == 6:
    detail_parts.append("2 bars {:.1f}m wide, {:.1f}m gap".format(base_W * p_bar_ratio, p_split_gap))

b_name = BASE_SHAPE_NAMES[b_shape] if b_shape < len(BASE_SHAPE_NAMES) else "Unknown"
print("MASSING: Base={} + Section={} + Plan={}".format(b_name, s_name, p_name))
print("Floors: {} x {:.1f}m = {:.1f}m total".format(nf, fh, height))
if detail_parts:
    print("Params: {}".format(", ".join(detail_parts)))
if len(void_floors) > 0:
    print("Void floors: {} ({} open)".format(sorted(void_floors), len(void_floors)))
print("GFA: {:.1f} m2  |  Volume: {:.1f} m3".format(total_area, vol))
print("Efficiency vs base: {:.1%}".format(eff))
print("Footprint: {:.1f} x {:.1f}m ({:.1f} m2)".format(base_W, base_D, base_area))
print("Mass parts: {}".format(len(mass_parts)))
print("Orientation: {:.1f} deg{}".format(ori, " (scaled to {:.0%} to fit site)".format(_fit_scale) if _fit_scale < 0.999 else ""))
print("Top params: scale={:.3f} offset=({:.1f},{:.1f}) rot={:.1f} has_top_curve={}".format(p_top_scale, p_top_offset_x, p_top_offset_y, p_top_rotation, has_top_curve))

# ── Export JSON bundle ─────────────────────────────────────────────────────
_massing_export = {
    "baseShape": b_shape,
    "baseShapeName": b_name,
    "baseScale": round(b_scale, 3),
    "sectionType": s_type,
    "sectionTypeName": s_name,
    "planType": p_type,
    "planTypeName": p_name,
    "massingArea": round(total_area, 1),
    "massingVolume": round(vol, 1),
    "efficiency": round(eff, 3),
    "floors": nf,
    "floorHeight": fh,
    "orientation": ori,
    "topCurveConnected": has_top_curve,
    "params": {}
}
if not has_top_curve:
    if p_top_scale != 1.0:
        _massing_export["params"]["topScale"] = round(p_top_scale, 3)
    if p_top_offset_x != 0:
        _massing_export["params"]["topOffsetX"] = round(p_top_offset_x, 2)
    if p_top_offset_y != 0:
        _massing_export["params"]["topOffsetY"] = round(p_top_offset_y, 2)
    if p_top_rotation != 0:
        _massing_export["params"]["topRotation"] = round(p_top_rotation, 1)
if s_type == 1:
    _massing_export["params"]["podiumFloors"] = p_podium_floors
    _massing_export["params"]["towerRatio"] = round(p_tower_ratio, 3)
elif s_type == 2:
    _massing_export["params"]["setbackInterval"] = p_setback_interval
    _massing_export["params"]["setbackDepth"] = round(p_setback_depth, 2)
elif s_type == 3:
    _massing_export["params"]["stiltFloors"] = p_stilt_floors
elif s_type == 4:
    _massing_export["params"]["gardenInterval"] = p_garden_interval
    _massing_export["params"]["gardenFloors"] = p_garden_floors
if _is_courtyard:
    _massing_export["params"]["courtyardRatio"] = round(p_courtyard_ratio, 3)
    _massing_export["params"]["courtyardZone"] = _courtyard_zone
    _massing_export["params"]["courtyardZoneName"] = COURTYARD_ZONE_NAMES[_courtyard_zone] if 0 <= _courtyard_zone < len(COURTYARD_ZONE_NAMES) else "Both"
elif p_type == 4:
    _massing_export["params"]["voidCorner"] = p_void_corner
    _massing_export["params"]["voidRatio"] = round(p_void_ratio, 3)
elif p_type == 5:
    _massing_export["params"]["voidRatio"] = round(p_void_ratio, 3)
elif p_type == 6:
    _massing_export["params"]["splitGap"] = round(p_split_gap, 2)
    _massing_export["params"]["barRatio"] = round(p_bar_ratio, 3)

export_json = json.dumps(_massing_export)
# ---------- end gh_massing ----------
gh_structure = Gh_structure(
    base_curve=gh_zoning_envelope.buildableFootprint,
    floor_curves=gh_massing.floor_curves,
    floors=python_3_script.floors,
    floor_height=python_3_script.floor_height,
    floor_slabs=gh_massing.floor_slabs,
    structural_span=python_3_script.structural_span,
    lateral_system=python_3_script.lateral_system,
    base_shape=python_3_script.base_shape,
    base_scale=python_3_script.base_scale,
    orientation=python_3_script.orientation,
    top_scale=python_3_script.top_scale,
    top_rotation=python_3_script.top_rotation,
    section_type=python_3_script.section_type,
    podium_floors=python_3_script.podium_floors,
    tower_ratio=python_3_script.tower_ratio,
    stilt_floors=python_3_script.stilt_floors,
    garden_interval=python_3_script.garden_interval,
    garden_floors=python_3_script.garden_floors,
    plan_type=python_3_script.plan_type,
    courtyard_ratio=python_3_script.courtyard_ratio,
    void_corner=python_3_script.void_corner,
    void_ratio=python_3_script.void_ratio,
    split_gap=python_3_script.split_gap,
    bar_ratio=python_3_script.bar_ratio,
    column_shape=python_3_script.column_shape,
    column_size=python_3_script.column_size)  # -> out, column_lines, primary_beam_lines, secondary_beam_lines, support_points, gravity_vector, col_id, primary_id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; inputs floor_curves: list, floor_slabs: list
# ---------- gh_structure: Python ----------
# ArchSim Structure — Column Grid + Karamba Line Model
# ─────────────────────────────────────────────────────────────────────────────
# Main GHPython component. Heavy logic in structure_helpers.py.
#
# INPUTS:
#   base_curve       Curve      — Base footprint
#   floor_curves     List[Curve]— Per-floor curves from massing (optional)
#   floor_slabs      List[Brep] — Per-floor slab breps (edges = primary beams)
#   floors           Integer    — Number of floors
#   floor_height     Number     — Floor-to-floor height (m)
#   structural_span  Number     — Target column spacing (m, 6-12)
#   lateral_system   Integer    — 0=RC Core  1=Perimeter Walls  2=Moment Frame  3=Coupled Cores
#   base_shape       Integer    — 0=Rect 1=Ellipse 2=Circle 3=Chamfered 4=Diamond
#   base_scale       Number     — 0.3-1.0
#   orientation      Number     — Rotation degrees
#   top_scale        Number     — Top vs base scale 0.1-1.0
#   top_rotation     Number     — Twist angle degrees
#   section_type     Integer    — 0=Straight 1=Podium+Tower 2=Stepped 3=Stilt 4=SkyGarden
#   podium_floors    Integer    — Podium height (section_type=1)
#   tower_ratio      Number     — Tower footprint ratio (section_type=1)
#   stilt_floors     Integer    — Open ground floors (section_type=3)
#   garden_interval  Integer    — Sky garden every N floors (section_type=4, default 6)
#   garden_floors    Integer    — Sky garden floor count (section_type=4, default 1)
#   plan_type        Integer    — 0=Solid 1..3=Courtyard 4=L 5=U 6=Split
#   courtyard_ratio  Number     — Courtyard void ratio
#   void_corner      Integer    — Corner for L (0=NE 1=NW 2=SW 3=SE)
#   void_ratio       Number     — Void ratio for L/U
#   split_gap        Number     — Gap between bars (m)
#   bar_ratio        Number     — Width ratio per bar
#   column_shape     Integer    — 0=Square 1=Round
#   column_size      Number     — Column width/diameter (m)
#
# OUTPUTS:
#   column_lines, primary_beam_lines, secondary_beam_lines
#   support_points, gravity_vector
#   col_id, primary_id, secondary_id
#   core_geometry, actual_span_x, actual_span_y
#   export_json, out
# ─────────────────────────────────────────────────────────────────────────────

import Rhino.Geometry as rg
import math
import json
import sys
import os

# ── Import helpers ──────────────────────────────────────────────────────────
# Add mcp directory to path so structure_helpers can be imported.
try:
    _ghdoc = ghenv.Component.OnPingDocument()
    _ghpath = _ghdoc.FilePath if _ghdoc else ""
    if _ghpath:
        _mcp = os.path.normpath(os.path.join(os.path.dirname(_ghpath),
               "app", "ClaudeCode", "Claude_Project_ArchSimV2", "mcp"))
        if os.path.isdir(_mcp) and _mcp not in sys.path:
            sys.path.insert(0, _mcp)
except:
    pass
# Also try the script's own directory (if __file__ is defined)
try:
    _self_dir = os.path.dirname(os.path.abspath(__file__))
    if _self_dir not in sys.path:
        sys.path.insert(0, _self_dir)
except:
    pass

# Force reload during development
if "structure_helpers" in sys.modules:
    del sys.modules["structure_helpers"]
import structure_helpers as sh

# ── Safe param readers ──────────────────────────────────────────────────────
def safe_int(val, default):
    if val is None or str(val) == "None":
        return default
    try:    return int(val)
    except: return default

def safe_float(val, default):
    if val is None or str(val) == "None":
        return default
    try:    return float(val)
    except: return default

# ── Coerce base_curve ────────────────────────────────────────────────────────
crv = None
if base_curve is not None:
    if hasattr(base_curve, "GetBoundingBox"):
        crv = base_curve
    elif hasattr(base_curve, "Geometry"):
        crv = base_curve.Geometry
    else:
        try:
            import rhinoscriptsyntax as rs
            crv = rs.coercecurve(base_curve)
        except:
            pass

if crv is None:
    out = "ERROR: base_curve is None"
    column_lines = []; primary_beam_lines = []; secondary_beam_lines = []
    support_points = []; gravity_vector = rg.Vector3d(0, 0, -1)
    col_id = "COL"; primary_id = "PB"; secondary_id = "SB"
    core_geometry = []; actual_span_x = 0.0; actual_span_y = 0.0
    export_json = json.dumps({})
    raise Exception(out)

# ── Read all optional inputs safely ──────────────────────────────────────────
_inputs = {}
_input_defaults = {
    "floor_curves": None, "floor_slabs": None,
    "floors": 10, "floor_height": 3.6, "structural_span": 8.0,
    "lateral_system": 0,
    "base_shape": 0, "base_scale": 1.0, "orientation": 0.0,
    "top_scale": 1.0, "top_rotation": 0.0,
    "section_type": 0, "podium_floors": 3, "tower_ratio": 0.5,
    "plan_type": 0, "courtyard_ratio": 0.25, "void_corner": 0,
    "void_ratio": 0.4, "split_gap": 4.0, "bar_ratio": 0.4,
    "column_shape": 0, "column_size": 0.5, "stilt_floors": 2,
    "garden_interval": 6, "garden_floors": 1,
}
for _k, _def in _input_defaults.items():
    try:
        _v = eval(_k)
        _inputs[_k] = _v if _v is not None and str(_v) != "None" else _def
    except:
        _inputs[_k] = _def

# ── Coerce floor_curves + floor_slabs ────────────────────────────────────────
import rhinoscriptsyntax as rs
import System

_fc_list = []
_has_fc = False
try:
    _fc_raw = _inputs["floor_curves"]
    if _fc_raw is not None:
        fc_items = list(_fc_raw) if hasattr(_fc_raw, "__iter__") else [_fc_raw]
        for fc_item in fc_items:
            fc = None
            if isinstance(fc_item, System.Guid):       fc = rs.coercecurve(fc_item)
            elif hasattr(fc_item, "GetBoundingBox"):    fc = fc_item
            elif hasattr(fc_item, "Geometry"):          fc = fc_item.Geometry
            elif hasattr(fc_item, "Value"):             fc = fc_item.Value
            if fc is not None and hasattr(fc, "IsClosed"):
                _fc_list.append(fc)
        if len(_fc_list) >= 2:
            _has_fc = True
except:
    _fc_list = []

_fs_list = []
_has_fs = False
try:
    _fs_raw = _inputs["floor_slabs"]
    if _fs_raw is not None:
        fs_items = list(_fs_raw) if hasattr(_fs_raw, "__iter__") else [_fs_raw]
        for fs_item in fs_items:
            fs = None
            if isinstance(fs_item, System.Guid):     fs = rs.coercebrep(fs_item)
            elif hasattr(fs_item, "Edges"):          fs = fs_item
            elif hasattr(fs_item, "Geometry"):       fs = fs_item.Geometry
            elif hasattr(fs_item, "Value"):          fs = fs_item.Value
            if fs is not None and hasattr(fs, "Edges"):
                _fs_list.append(fs)
        if len(_fs_list) >= 1:
            _has_fs = True
except:
    _fs_list = []

# ── Parameters ───────────────────────────────────────────────────────────────
nf   = safe_int(_inputs["floors"], 10)
fh   = safe_float(_inputs["floor_height"], 3.6)
span = max(3.0, safe_float(_inputs["structural_span"], 8.0))
lat  = safe_int(_inputs["lateral_system"], 0)
H    = nf * fh

b_shape        = safe_int(_inputs["base_shape"], 0)
b_scale        = max(0.3, min(1.0, safe_float(_inputs["base_scale"], 1.0)))
ori            = safe_float(_inputs["orientation"], 0.0)
p_top_scale    = max(0.1, min(1.0, safe_float(_inputs["top_scale"], 1.0)))
p_top_rotation = safe_float(_inputs["top_rotation"], 0.0)
s_type         = safe_int(_inputs["section_type"], 0)
p_podium_floors = safe_int(_inputs["podium_floors"], 3)
p_tower_ratio  = max(0.2, min(0.9, safe_float(_inputs["tower_ratio"], 0.5)))

p_type            = safe_int(_inputs["plan_type"], 0)
p_courtyard_ratio = max(0.05, min(0.6, safe_float(_inputs["courtyard_ratio"], 0.25)))
p_void_corner     = safe_int(_inputs["void_corner"], 0)
p_void_ratio      = max(0.2, min(0.6, safe_float(_inputs["void_ratio"], 0.4)))
p_split_gap       = max(1.0, safe_float(_inputs["split_gap"], 4.0))
p_bar_ratio       = max(0.15, min(0.45, safe_float(_inputs["bar_ratio"], 0.4)))

p_col_shape = safe_int(_inputs["column_shape"], 0)
p_col_size  = max(0.2, min(2.0, safe_float(_inputs["column_size"], 0.5)))
p_stilt_floors = safe_int(_inputs["stilt_floors"], 2)
p_stilt_col_span = max(3.0, safe_float(_inputs.get("stilt_col_span", span), span))
p_garden_interval = max(3, safe_int(_inputs["garden_interval"], 6))
p_garden_floors = max(1, safe_int(_inputs["garden_floors"], 1))

_is_courtyard = p_type in (1, 2, 3)
_has_twist = abs(p_top_rotation) > 0.001
_use_radial = b_shape in (1, 2, 3, 4)

print("Structure: shape={} sType={} pType={} fc={} span={} floors={}".format(
    b_shape, s_type, p_type, _has_fc, span, nf))

# ══════════════════════════════════════════════════════════════════════════════
# STEP 1: BUILD PER-FLOOR CURVES
# ══════════════════════════════════════════════════════════════════════════════
_floor_crvs_flat = []
_floor_crvs_notwist = []

if _has_fc:
    for i in range(len(_fc_list)):
        _floor_crvs_flat.append(sh.flatten_crv(_fc_list[i]))
    while len(_floor_crvs_flat) <= nf:
        _floor_crvs_flat.append(_floor_crvs_flat[-1].DuplicateCurve())
    _floor_crvs_notwist = [c.DuplicateCurve() for c in _floor_crvs_flat]
    print("Using {} floor_curves from massing".format(len(_fc_list)))
else:
    shaped = sh.build_shaped_curve(crv, b_shape, b_scale, ori)
    _floor_crvs_flat, _floor_crvs_notwist = sh.build_floor_curves(
        shaped, nf, s_type, p_top_scale, p_top_rotation,
        p_podium_floors, p_tower_ratio)
    print("Derived floor curves from base_curve + params")

_ground_crv = _floor_crvs_flat[0]

# ── Void floors ──────────────────────────────────────────────────────────────
_void_beam_floors = {0}  # ground: no beams, but columns OK
_void_col_floors = set()
if s_type == 3:
    p_stilt_floors = max(1, min(p_stilt_floors, nf - 1))
    for vi in range(0, p_stilt_floors):
        _void_beam_floors.add(vi)
        _void_col_floors.add(vi)
elif s_type == 4:
    # Sky Garden: periodic void floors matching massing logic
    p_garden_floors = min(p_garden_floors, p_garden_interval - 1)
    for i in range(1, nf + 1):
        if i % p_garden_interval == 0:
            for g in range(p_garden_floors):
                vi = i + g
                if vi < nf:  # never void the top floor
                    _void_beam_floors.add(vi)
                    _void_col_floors.add(vi)
print("Void beam: {}  Void col: {}".format(sorted(_void_beam_floors), sorted(_void_col_floors)))

# ── Plan void ────────────────────────────────────────────────────────────────
def _make_void(fi):
    return sh.make_void_for_floor(fi, _floor_crvs_notwist, p_type, _is_courtyard,
                                  p_courtyard_ratio, p_void_corner, p_void_ratio,
                                  p_split_gap, p_bar_ratio)

_plan_void_crv = _make_void(0)
_plan_void_ccw = sh.ensure_ccw(_plan_void_crv) if _plan_void_crv is not None else None

def _point_in_void(pt):
    if _plan_void_ccw is None or not _plan_void_ccw.IsClosed:
        return False
    return _plan_void_ccw.Contains(pt, rg.Plane.WorldXY, 0.1) != rg.PointContainment.Outside

# ══════════════════════════════════════════════════════════════════════════════
# STEP 2: GENERATE BEAMS
# ══════════════════════════════════════════════════════════════════════════════
gnd_bb = _ground_crv.GetBoundingBox(True)
full_W = gnd_bb.Max.X - gnd_bb.Min.X
full_D = gnd_bb.Max.Y - gnd_bb.Min.Y

all_ring_lns = []
all_radial_lns = []

# Build slab boundaries
_slab_crvs_by_z = sh.build_slab_boundaries(_fs_list) if _has_fs else {}
if _slab_crvs_by_z:
    print("Slab boundaries at {} Z levels".format(len(_slab_crvs_by_z)))

# Generate beams per floor
for fi in range(nf + 1):
    z = fi * fh
    if fi in _void_beam_floors:
        print("  Floor {}: beam-void".format(fi))
        continue

    fi_crv = sh.ensure_ccw(_floor_crvs_flat[fi])
    floor_void = _make_void(fi)
    if floor_void is not None and _has_twist:
        t = float(fi) / max(1, nf)
        tw = t * p_top_rotation
        if abs(tw) > 0.001:
            floor_void = sh.rotate_curve(floor_void, tw, sh.get_centroid(fi_crv))

    try:
        rings, radials = sh.generate_beams_for_floor(fi_crv, z, floor_void, _use_radial, span, _is_courtyard)
        all_ring_lns.extend(rings)
        all_radial_lns.extend(radials)
        print("  Floor {}: {} ring + {} radial".format(fi, len(rings), len(radials)))
    except Exception as ex:
        print("  Floor {} ERROR: {}".format(fi, ex))

    # Stepped transition: add larger footprint beams
    if fi > 0 and s_type == 2:
        prev_crv = sh.ensure_ccw(_floor_crvs_flat[fi - 1])
        if sh.get_area(prev_crv) > 0 and sh.get_area(fi_crv) < sh.get_area(prev_crv) * 0.85:
            prev_void = _make_void(fi - 1)
            if prev_void is not None and _has_twist:
                t_p = float(fi) / max(1, nf)
                tw_p = t_p * p_top_rotation
                if abs(tw_p) > 0.001:
                    prev_void = sh.rotate_curve(prev_void, tw_p, sh.get_centroid(prev_crv))
            try:
                tr, trad = sh.generate_beams_for_floor(prev_crv, z, prev_void, _use_radial, span, _is_courtyard)
                all_ring_lns.extend(tr)
                all_radial_lns.extend(trad)
                print("  Floor {} STEP: +{} ring +{} radial".format(fi, len(tr), len(trad)))
            except:
                pass

# ── SkyGarden / Stilt transition beams ──────────────────────────────────────
# Add beams at the bottom and top of each void range so the structure has
# "cap" beams framing the open zone (uses the adjacent non-void floor curve).
if _void_col_floors:
    _sorted_vc = sorted(_void_col_floors)
    _vc_ranges = []
    _rs, _re = _sorted_vc[0], _sorted_vc[0]
    for _vi in _sorted_vc[1:]:
        if _vi == _re + 1:
            _re = _vi
        else:
            _vc_ranges.append((_rs, _re))
            _rs, _re = _vi, _vi
    _vc_ranges.append((_rs, _re))

    def _gen_beams_at(fi_ref, z_target):
        """Generate beams using fi_ref floor curve at z_target elevation."""
        fc = sh.ensure_ccw(_floor_crvs_flat[fi_ref])
        fv = _make_void(fi_ref)
        if fv is not None and _has_twist:
            t = float(fi_ref) / max(1, nf)
            tw = t * p_top_rotation
            if abs(tw) > 0.001:
                fv = sh.rotate_curve(fv, tw, sh.get_centroid(fc))
        try:
            r, rd = sh.generate_beams_for_floor(fc, z_target, fv, _use_radial, span, _is_courtyard)
            all_ring_lns.extend(r)
            all_radial_lns.extend(rd)
            print("  Void-cap at Z={:.1f} (ref fi={}): +{} ring +{} radial".format(
                z_target, fi_ref, len(r), len(rd)))
        except:
            pass

    for (_vs, _ve) in _vc_ranges:
        # Bottom cap: beams at bottom of void zone using floor below
        z_bot = _vs * fh
        if _vs > 0 and (_vs - 1) not in _void_beam_floors:
            if z_bot not in set(round(fi * fh, 1) for fi in range(nf+1) if fi not in _void_beam_floors):
                _gen_beams_at(_vs - 1, z_bot)
        # Top cap: beams at top of void zone using floor above
        z_top = (_ve + 1) * fh
        fi_above = _ve + 1
        if fi_above <= nf and fi_above not in _void_beam_floors:
            if z_top not in set(round(fi * fh, 1) for fi in range(nf+1) if fi not in _void_beam_floors):
                _gen_beams_at(fi_above, z_top)

# ── Grid info ────────────────────────────────────────────────────────────────
if _use_radial:
    r_max = max(full_W, full_D) / 2.0
    n_rings = max(2, int(math.ceil(r_max / span)))
    a_e, b_e = full_W / 2.0, full_D / 2.0
    p_g = math.pi * (3*(a_e+b_e) - math.sqrt((3*a_e+b_e)*(a_e+3*b_e)))
    n_rad = max(8, int(math.ceil(p_g / span)))
    grid_type = "radial ({}r x {}rad)".format(n_rings, n_rad)
    actual_span_x = r_max / n_rings
    actual_span_y = actual_span_x
    nx, ny = n_rings, n_rad
    p_dir, s_dir = "ring", "radial"
else:
    nx = max(2, int(math.ceil(full_W / span)))
    ny = max(2, int(math.ceil(full_D / span)))
    actual_span_x = full_W / nx
    actual_span_y = full_D / ny
    grid_type = "orthogonal ({}x{})".format(nx, ny)
    p_dir, s_dir = "edge", "grid"

# ══════════════════════════════════════════════════════════════════════════════
# STEP 3: ASSEMBLE PRIMARY / SECONDARY BEAMS
# ══════════════════════════════════════════════════════════════════════════════
primary_beam_lines = list(all_ring_lns)
_void_z_set = set(round(vi * fh, 1) for vi in _void_beam_floors)

if _has_fs:
    for slab in _fs_list:
        slab_bb = slab.GetBoundingBox(True)
        if round(slab_bb.Min.Z, 1) in _void_z_set:
            continue
        edges = slab.Edges
        if edges is None or edges.Count == 0:
            continue
        edge_hash = set()
        for ei in range(edges.Count):
            ec = edges[ei].DuplicateCurve()
            if ec is None or ec.GetLength() < 0.1:
                continue
            mid = ec.PointAtNormalizedLength(0.5)
            # Skip slab edges inside plan void (courtyard/L/U/split)
            if _plan_void_ccw is not None and _plan_void_ccw.IsClosed:
                mid_2d = rg.Point3d(mid.X, mid.Y, 0)
                if _plan_void_ccw.Contains(mid_2d, rg.Plane.WorldXY, 0.1) != rg.PointContainment.Outside:
                    continue
            mk = (round(mid.X, 1), round(mid.Y, 1), round(mid.Z, 1))
            if mk not in edge_hash:
                edge_hash.add(mk)
                primary_beam_lines.append(ec)
    print("Primary: {} (ring + slab edges)".format(len(primary_beam_lines)))
else:
    for fi in range(nf + 1):
        if fi in _void_beam_floors:
            continue
        z = fi * fh
        fi_crv = _floor_crvs_flat[fi]
        if fi_crv is None or fi_crv.GetLength() < 1.0:
            continue
        crv_at_z = fi_crv.DuplicateCurve()
        crv_at_z.Translate(rg.Vector3d(0, 0, z))
        if _plan_void_crv is not None:
            flat_c = sh.flatten_crv(fi_crv)
            ix = rg.Intersect.Intersection.CurveCurve(flat_c, _plan_void_crv, 0.01, 0.01)
            if ix is not None and ix.Count >= 2:
                sp = sorted([ix[i].ParameterA for i in range(ix.Count)])
                splits = crv_at_z.Split(sp)
                if splits:
                    for seg in splits:
                        mid = seg.PointAtNormalizedLength(0.5)
                        if not _point_in_void(rg.Point3d(mid.X, mid.Y, 0)):
                            primary_beam_lines.append(seg)
                    continue
        primary_beam_lines.append(crv_at_z)
    print("Primary: {} (fallback)".format(len(primary_beam_lines)))

# Re-trim secondary beams to actual slab boundaries
secondary_beam_lines = sh.retrim_secondary_beams(all_radial_lns, _slab_crvs_by_z)

# Subdivide all beams into short segments for Karamba node merging.
# Karamba only merges element ENDPOINTS within limit distance (0.5m),
# so beams must be broken into segments <= 0.5m.
primary_beam_lines = sh.subdivide_beams(primary_beam_lines, max_seg_len=0.5)
secondary_beam_lines = sh.subdivide_beams(secondary_beam_lines, max_seg_len=0.5)
print("After subdivide: {} primary, {} secondary".format(
    len(primary_beam_lines), len(secondary_beam_lines)))

# ══════════════════════════════════════════════════════════════════════════════
# STEP 4: COLUMNS
# ══════════════════════════════════════════════════════════════════════════════
# Pre-compute core center and size for column exclusion in stilt/garden zones
_gnd_nt_bb = _floor_crvs_notwist[0].GetBoundingBox(True)
_gnd_c = sh.get_centroid(_floor_crvs_notwist[0])
W = _gnd_nt_bb.Max.X - _gnd_nt_bb.Min.X
D = _gnd_nt_bb.Max.Y - _gnd_nt_bb.Min.Y
cx, cy = _gnd_c.X, _gnd_c.Y
_core_size = max(2.0, round(min(W, D) * 0.18, 2)) if lat == 0 else 0

_all_beams = all_ring_lns + all_radial_lns
col_lns, col_pts = sh.generate_columns(
    nf, fh, span, s_type, p_top_rotation,
    _floor_crvs_flat, _all_beams, primary_beam_lines, secondary_beam_lines,
    _void_col_floors, make_void_fn=_make_void, b_shape=b_shape,
    core_cx=cx, core_cy=cy, core_size=_core_size,
    stilt_col_span=p_stilt_col_span)

# ══════════════════════════════════════════════════════════════════════════════
# STEP 5: LATERAL SYSTEM
# ══════════════════════════════════════════════════════════════════════════════

core_geom, core_note = sh.build_lateral_system(
    lat, p_type, W, D, H, nf, fh,
    cx, cy, _gnd_nt_bb.Min.X, _gnd_nt_bb.Min.Y, _gnd_nt_bb.Max.X, _gnd_nt_bb.Max.Y,
    p_void_ratio, p_void_corner, p_bar_ratio, p_split_gap, _point_in_void,
    void_col_floors=_void_col_floors,
    floor_crvs=_floor_crvs_flat, b_shape=b_shape,
    make_void_fn=_make_void, has_twist=_has_twist,
    top_rotation=p_top_rotation)

# ══════════════════════════════════════════════════════════════════════════════
# OUTPUTS
# ══════════════════════════════════════════════════════════════════════════════
column_lines   = col_lns

# Extract support points directly from column line base endpoints
# to guarantee exact coordinate match with Karamba nodes
support_points = [cl.PointAtStart for cl in col_lns if abs(cl.PointAtStart.Z) < 0.01]
# Add core base support points (4 corners at z=0)
if lat == 0 and _core_size > 0:
    cs2 = _core_size / 2.0
    for (ccx, ccy) in [(cx-cs2, cy-cs2), (cx+cs2, cy-cs2),
                        (cx+cs2, cy+cs2), (cx-cs2, cy+cs2)]:
        support_points.append(rg.Point3d(ccx, ccy, 0))
print("Supports: {} column bases + {} core".format(
    len([cl for cl in col_lns if abs(cl.PointAtStart.Z) < 0.01]),
    4 if lat == 0 and _core_size > 0 else 0))
gravity_vector = rg.Vector3d(0, 0, -5.0)
core_geometry  = core_geom

col_id       = "COL"
primary_id   = "PB"
secondary_id = "SB"

lat_labels = ["RC Core", "Perimeter Walls", "Moment Frame", "Reserved"]
lat_label  = lat_labels[lat] if lat < len(lat_labels) else "Unknown"
PLAN_NAMES = ["Solid", "Courtyard", "Courtyard (Tower)", "Courtyard (Podium)",
              "L-Shape", "U-Shape", "Split / Dual Bar"]
p_name = PLAN_NAMES[p_type] if p_type < len(PLAN_NAMES) else "Solid"
BASE_NAMES = ["Rectangle", "Ellipse", "Circle", "Chamfered", "Diamond"]
b_name = BASE_NAMES[b_shape] if b_shape < len(BASE_NAMES) else "Rectangle"
src = "floor_curves ({})".format(len(_fc_list)) if _has_fc else "derived ({})".format(b_name)

out = (
    "Grid: {}  |  Span={:.2f}m\n"
    "Primary: {} ({})  Secondary: {} ({})\n"
    "Columns: {} ({}mm {})  |  Lateral: {} ({})\n"
    "Source: {}  |  Plan: {}\n"
    "Total: {} col + {} PB + {} SB = {}"
).format(
    grid_type, span,
    p_dir, len(primary_beam_lines),
    s_dir, len(secondary_beam_lines),
    len(col_pts), int(p_col_size * 1000),
    "Round" if p_col_shape == 1 else "Square",
    lat_label, core_note, src, p_name,
    len(col_lns), len(primary_beam_lines), len(secondary_beam_lines),
    len(col_lns) + len(primary_beam_lines) + len(secondary_beam_lines)
)

export_json = json.dumps({
    "structuralSpan": round(span, 3),
    "structuralSpanX": round(actual_span_x, 3),
    "structuralSpanY": round(actual_span_y, 3),
    "lateralSystem": lat_label,
    "columnCount": len(col_pts),
    "columnShape": "Round" if p_col_shape == 1 else "Square",
    "columnSize": round(p_col_size, 3),
    "gridType": "radial" if _use_radial else "orthogonal",
    "gridX": nx, "gridY": ny,
    "planType": p_name,
    "baseShape": b_name,
    "hasVoid": _plan_void_crv is not None,
    "floorCurvesConnected": _has_fc,
    "coreCenter": [round(cx, 2), round(cy, 2)],
    "totalElements": len(col_lns) + len(primary_beam_lines) + len(secondary_beam_lines)
})
# ---------- end gh_structure ----------
gh_structure_2 = Gh_structure(
    floor_curves=gh_massing.floor_curves,
    floors=python_3_script.floors,
    floor_height=python_3_script.floor_height,
    floor_slabs=gh_massing.floor_slabs,
    wwRatio=python_3_script.wwRatio,
    window_type=python_3_script.window_type,
    bay_spacing=python_3_script.bay_spacing,
    section_type=python_3_script.section_type,
    stilt_floors=python_3_script.stilt_floors,
    garden_interval=python_3_script.garden_interval,
    garden_floors=python_3_script.garden_floors,
    plan_type=python_3_script.plan_type,
    courtyard_ratio=python_3_script.courtyard_ratio,
    void_corner=python_3_script.void_corner,
    void_ratio=python_3_script.void_ratio,
    split_gap=python_3_script.split_gap,
    bar_ratio=python_3_script.bar_ratio)  # -> out, windows, wall_panels, mullion_lines, export_json, export_json_2; inputs floor_curves: list, floor_slabs: list
# ---------- gh_structure_2: Python ----------
# ArchSim Window Visualiser — Rhino 8 / Python 3
# ─────────────────────────────────────────────────────────────────────────────
# Generates window/wall panels per floor using per-floor curves from massing.
# Handles taper, twist, podium/tower, stepped, stilt, sky garden, and plan voids.
#
# INPUTS:
#   floor_curves     List[Curve] — Per-floor curves from massing (or structure)
#   floor_slabs      List[Brep]  — Per-floor slab breps from massing (optional, for void detection)
#   floors           Integer     — Number of floors
#   floor_height     Number      — Floor-to-floor height m
#   wwRatio          Number      — Window-to-wall ratio 0.0–1.0
#   window_type      Integer     — 0=Ribbon  1=CurtainWall  2=Punched  3=Vertical
#   bay_spacing      Number      — Bay/mullion spacing m (default 1.5)
#   section_type     Integer     — 0=Straight 1=Podium+Tower 2=Stepped 3=Stilt 4=SkyGarden
#   stilt_floors     Integer     — Open ground floors (section_type=3)
#   garden_interval  Integer     — Sky garden every N floors (section_type=4, default 6)
#   garden_floors    Integer     — Sky garden floor count (section_type=4, default 1)
#   plan_type        Integer     — 0=Solid 1..3=Courtyard 4=L 5=U 6=Split
#   courtyard_ratio  Number      — Courtyard void ratio
#   void_corner      Integer     — Corner for L (0=NE 1=NW 2=SW 3=SE)
#   void_ratio       Number      — Void ratio for L/U
#   split_gap        Number      — Gap between bars (m)
#   bar_ratio        Number      — Width ratio per bar
#
# OUTPUTS:
#   windows       List[Brep] — Glazing surfaces  → Custom Preview: blue
#   wall_panels   List[Brep] — Opaque surfaces   → Custom Preview: grey
#   mullion_lines List[Curve]                    → Custom Preview: dark
#   export_json   String     — JSON bundle (connect to gh-params-export)
#   out           String     — Debug/summary
# ─────────────────────────────────────────────────────────────────────────────

import Rhino.Geometry as rg
import math
import json
import sys
import os

# ── Import structure_helpers for void curve generation ────────────────────────
try:
    _ghdoc = ghenv.Component.OnPingDocument()
    _ghpath = _ghdoc.FilePath if _ghdoc else ""
    if _ghpath:
        _mcp = os.path.normpath(os.path.join(os.path.dirname(_ghpath),
               "app", "ClaudeCode", "Claude_Project_ArchSimV2", "mcp"))
        if os.path.isdir(_mcp) and _mcp not in sys.path:
            sys.path.insert(0, _mcp)
except:
    pass
try:
    _this_dir = os.path.dirname(os.path.abspath(__file__))
    if _this_dir not in sys.path:
        sys.path.insert(0, _this_dir)
except:
    pass

import structure_helpers as sh

# ── Parameters ────────────────────────────────────────────────────────────────
_wwr    = max(0.0, min(1.0, float(wwRatio)       if wwRatio       is not None else 0.4))
_fh     = float(floor_height)  if floor_height    is not None else 3.6
_nf     = int(floors)          if floors           is not None else 10
_wtype  = int(window_type)     if window_type      is not None else 0
_bay    = float(bay_spacing)   if bay_spacing      is not None else 1.5
_stype  = int(section_type)    if section_type     is not None else 0
_ptype  = int(plan_type)       if plan_type        is not None else 0

_stilt_fl    = int(stilt_floors)     if "stilt_floors"     in dir() and stilt_floors     is not None else 2
_garden_int  = int(garden_interval)  if "garden_interval"  in dir() and garden_interval  is not None else 6
_garden_fl   = int(garden_floors)    if "garden_floors"    in dir() and garden_floors    is not None else 1
_court_ratio = float(courtyard_ratio) if "courtyard_ratio" in dir() and courtyard_ratio is not None else 0.25
_void_corner = int(void_corner)      if "void_corner"      in dir() and void_corner     is not None else 0
_void_ratio  = float(void_ratio)     if "void_ratio"       in dir() and void_ratio      is not None else 0.3
_split_gap   = float(split_gap)      if "split_gap"        in dir() and split_gap        is not None else 3.0
_bar_ratio   = float(bar_ratio)      if "bar_ratio"        in dir() and bar_ratio        is not None else 0.35

# ── Coerce floor_curves ──────────────────────────────────────────────────────
_fc_list = []
if "floor_curves" in dir() and floor_curves is not None:
    for fc in floor_curves:
        if fc is not None:
            c = fc if hasattr(fc, "GetLength") else None
            if c is None:
                try:
                    import rhinoscriptsyntax as rs
                    c = rs.coercecurve(fc)
                except:
                    pass
            if c is not None:
                _fc_list.append(c)

if len(_fc_list) == 0:
    out = "ERROR: No floor_curves provided"
    windows = []; wall_panels = []; mullion_lines = []
    export_json = json.dumps({"wwRatio": _wwr, "windowType": _wtype, "baySpacing": _bay})
    raise Exception(out)

# ── Determine void floors (no windows at these levels) ────────────────────────
_void_floors = set()
if _stype == 3:  # Stilt — open ground floors have no facade
    _stilt_fl = max(1, min(_stilt_fl, _nf - 1))
    for vi in range(0, _stilt_fl):
        _void_floors.add(vi)
elif _stype == 4:  # Sky Garden
    _garden_fl = min(_garden_fl, _garden_int - 1)
    for i in range(1, _nf + 1):
        if i % _garden_int == 0:
            for g in range(_garden_fl):
                vi = i + g
                if vi < _nf:
                    _void_floors.add(vi)

# ── Plan void detection ──────────────────────────────────────────────────────
_is_courtyard = _ptype in (1, 2, 3)
_has_plan_void = _ptype > 0

# Build untwisted floor curves for void generation (just flatten Z to 0)
_fc_notwist = []
for fc in _fc_list:
    c = fc.DuplicateCurve()
    bb = c.GetBoundingBox(True)
    if abs(bb.Min.Z) > 0.01:
        c.Translate(rg.Vector3d(0, 0, -bb.Min.Z))
    _fc_notwist.append(c)

def _make_void(fi):
    """Generate plan void curve for floor fi."""
    if not _has_plan_void:
        return None
    idx = min(fi, len(_fc_notwist) - 1)
    return sh.make_void_for_floor(idx, _fc_notwist, _ptype, _is_courtyard,
                                  _court_ratio, _void_corner, _void_ratio,
                                  _split_gap, _bar_ratio)

# ── Quad Brep helper ──────────────────────────────────────────────────────────
def Q(a, b, c, d):
    """Planar quad Brep from 4 Point3d corners [BL, BR, TR, TL]."""
    ns = rg.NurbsSurface.CreateFromCorners(a, b, c, d)
    if ns:
        return ns.ToBrep()
    return None

# ── Segment extraction helper ─────────────────────────────────────────────────
def get_segments(crv, max_seg_len=1.5):
    """Extract facade segments from a curve.
    Linear segments are kept whole (or subdivided only if very long).
    Curved segments (arcs, ellipses) are subdivided into short straight pieces."""
    total_len = crv.GetLength()
    if total_len < 0.1:
        return []

    # Get sub-segments from the curve
    raw_segs = list(crv.DuplicateSegments())

    # If only 1 segment and closed (full ellipse/circle), subdivide directly
    if len(raw_segs) <= 1 and crv.IsClosed:
        n = max(8, int(math.ceil(total_len / max_seg_len)))
        result = []
        for i in range(n):
            p0 = crv.PointAtNormalizedLength(float(i) / n)
            p1 = crv.PointAtNormalizedLength(float(i + 1) / n)
            if p0.DistanceTo(p1) > 0.01:
                result.append(rg.LineCurve(p0, p1))
        return result

    # Process each segment individually: keep linear, subdivide curved
    result = []
    for seg in raw_segs:
        seg_len = seg.GetLength()
        if seg_len < 0.05:
            continue

        # Check if this segment is linear
        _is_linear = False
        try:
            _is_linear = seg.IsLinear(0.05)
        except:
            pass
        if not _is_linear and isinstance(seg, rg.LineCurve):
            _is_linear = True

        if _is_linear:
            # Linear segment: keep as single piece (facade uses full edge)
            result.append(seg)
        else:
            # Curved segment: subdivide into short straight pieces
            n = max(3, int(math.ceil(seg_len / max_seg_len)))
            for i in range(n):
                p0 = seg.PointAtNormalizedLength(float(i) / n)
                p1 = seg.PointAtNormalizedLength(min(float(i + 1) / n, 1.0))
                if p0.DistanceTo(p1) > 0.01:
                    result.append(rg.LineCurve(p0, p1))

    # Fallback: if nothing worked, subdivide the entire curve
    if len(result) == 0 and total_len > 0.1:
        n = max(8, int(math.ceil(total_len / max_seg_len)))
        for i in range(n):
            p0 = crv.PointAtNormalizedLength(float(i) / n)
            p1 = crv.PointAtNormalizedLength(float(i + 1) / n)
            if p0.DistanceTo(p1) > 0.01:
                result.append(rg.LineCurve(p0, p1))
    return result

# ── Generate facade panels for one edge segment at one floor ──────────────────
def _calc_bays(seg_len, bay):
    """Calculate bay count and width, keeping bays as close to target as possible.
    Uses floor to get full bays at target width, remainder absorbed into last bay."""
    if seg_len <= bay * 1.3:
        # Short segment: single bay
        return 1, seg_len
    n_full = int(math.floor(seg_len / bay))
    remainder = seg_len - n_full * bay
    # If remainder is too small (<30% of bay), merge into last full bay
    if remainder < bay * 0.3 and n_full > 1:
        return n_full, seg_len / n_full
    # If remainder is large enough, add as extra bay
    elif remainder >= bay * 0.3:
        return n_full + 1, seg_len / (n_full + 1)
    else:
        return max(1, n_full), seg_len / max(1, n_full)

def gen_panels(A, B, z0, fh, wwr, wtype, bay, wins, walls, mulls):
    """Generate window/wall panels for a single edge from A to B at floor z0."""
    dx = B.X - A.X
    dy = B.Y - A.Y
    seg_len = (dx*dx + dy*dy) ** 0.5
    if seg_len < 0.1:
        return
    ux = dx / seg_len
    uy = dy / seg_len
    ztop = z0 + fh

    def P(t, z):
        return rg.Point3d(A.X + ux * t, A.Y + uy * t, z)

    # ── TYPE 0 : Ribbon ──────────────────────────────────────────────────
    if wtype == 0:
        win_h  = fh * wwr
        sill_h = (fh - win_h) / 2.0
        gz0    = z0 + sill_h
        gz1    = gz0 + win_h

        if sill_h > 0.001:
            s = Q(P(0,z0), P(seg_len,z0), P(seg_len,gz0), P(0,gz0))
            if s: walls.append(s)
        if win_h > 0.001:
            s = Q(P(0,gz0), P(seg_len,gz0), P(seg_len,gz1), P(0,gz1))
            if s: wins.append(s)
        if ztop - gz1 > 0.001:
            s = Q(P(0,gz1), P(seg_len,gz1), P(seg_len,ztop), P(0,ztop))
            if s: walls.append(s)

    # ── TYPE 1 : Curtain Wall ────────────────────────────────────────────
    elif wtype == 1:
        spandrel = max(0.04, fh * (1.0 - wwr) / 2.0)
        gz0 = z0   + spandrel
        gz1 = ztop - spandrel

        n_bays, bay_w = _calc_bays(seg_len, bay)
        pier   = bay_w * 0.04

        if spandrel > 0.001:
            s = Q(P(0,z0),  P(seg_len,z0),  P(seg_len,gz0), P(0,gz0))
            if s: walls.append(s)
            s = Q(P(0,gz1), P(seg_len,gz1), P(seg_len,ztop), P(0,ztop))
            if s: walls.append(s)

        for b in range(n_bays):
            t0 = b * bay_w
            t1 = t0 + bay_w
            if gz1 - gz0 > 0.001:
                s = Q(P(t0+pier,gz0), P(t1-pier,gz0), P(t1-pier,gz1), P(t0+pier,gz1))
                if s: wins.append(s)
            if pier > 0.001:
                s = Q(P(t0,gz0),      P(t0+pier,gz0), P(t0+pier,gz1), P(t0,gz1))
                if s: walls.append(s)
                s = Q(P(t1-pier,gz0), P(t1,gz0),      P(t1,gz1),      P(t1-pier,gz1))
                if s: walls.append(s)
            if b > 0:
                mulls.append(rg.Line(P(t0,z0), P(t0,ztop)).ToNurbsCurve())

    # ── TYPE 2 : Punched ─────────────────────────────────────────────────
    elif wtype == 2:
        n_bays, bay_w = _calc_bays(seg_len, bay)
        win_w  = bay_w  * wwr
        pier   = (bay_w - win_w) / 2.0
        win_h  = fh * wwr
        sill_h = (fh - win_h) / 2.0
        gz0    = z0 + sill_h
        gz1    = gz0 + win_h

        for b in range(n_bays):
            t0  = b * bay_w
            t1  = t0 + bay_w
            tbl = t0 + pier
            tbr = tbl + win_w

            if pier > 0.001:
                s = Q(P(t0,z0),  P(tbl,z0),  P(tbl,ztop), P(t0,ztop))
                if s: walls.append(s)
                s = Q(P(tbr,z0), P(t1,z0),   P(t1,ztop),  P(tbr,ztop))
                if s: walls.append(s)
            if sill_h > 0.001:
                s = Q(P(tbl,z0),  P(tbr,z0),  P(tbr,gz0),  P(tbl,gz0))
                if s: walls.append(s)
            if ztop - gz1 > 0.001:
                s = Q(P(tbl,gz1), P(tbr,gz1), P(tbr,ztop), P(tbl,ztop))
                if s: walls.append(s)
            s = Q(P(tbl,gz0), P(tbr,gz0), P(tbr,gz1), P(tbl,gz1))
            if s: wins.append(s)

    # ── TYPE 3 : Vertical Strip ──────────────────────────────────────────
    elif wtype == 3:
        n_bays, bay_w = _calc_bays(seg_len, bay)
        win_w  = bay_w  * wwr
        pier   = (bay_w - win_w) / 2.0
        sill_h = fh * 0.08
        gz0    = z0   + sill_h
        gz1    = ztop - sill_h

        for b in range(n_bays):
            t0  = b * bay_w
            t1  = t0 + bay_w
            tbl = t0 + pier
            tbr = tbl + win_w

            if pier > 0.001:
                s = Q(P(t0,z0),  P(tbl,z0),  P(tbl,ztop), P(t0,ztop))
                if s: walls.append(s)
                s = Q(P(tbr,z0), P(t1,z0),   P(t1,ztop),  P(tbr,ztop))
                if s: walls.append(s)
            if sill_h > 0.001:
                s = Q(P(tbl,z0),  P(tbr,z0),  P(tbr,gz0),  P(tbl,gz0))
                if s: walls.append(s)
                s = Q(P(tbl,gz1), P(tbr,gz1), P(tbr,ztop), P(tbl,ztop))
                if s: walls.append(s)
            s = Q(P(tbl,gz0), P(tbr,gz0), P(tbr,gz1), P(tbl,gz1))
            if s: wins.append(s)


# ══════════════════════════════════════════════════════════════════════════════
# MAIN: Generate windows per floor
# ══════════════════════════════════════════════════════════════════════════════
windows_out       = []
wall_panels_out   = []
mullion_lines_out = []
debug_lines       = []

debug_lines.append("floors={}, fc_count={}, wtype={}, wwr={}, bay={}, void_floors={}".format(
    _nf, len(_fc_list), _wtype, _wwr, _bay, sorted(_void_floors)))

_win_floors = 0
for fi in range(_nf):
    z0 = fi * _fh

    # Skip void floors (stilt open, sky garden open)
    if fi in _void_floors:
        debug_lines.append("  fi={}: void — skip".format(fi))
        continue

    # Get floor curve for this level
    fc_idx = min(fi, len(_fc_list) - 1)
    fc = _fc_list[fc_idx]

    # Flatten curve to Z=0 for segment extraction, then use z0 for panel placement
    fc_flat = fc.DuplicateCurve()
    fc_bb = fc_flat.GetBoundingBox(True)
    if abs(fc_bb.Min.Z) > 0.01:
        fc_flat.Translate(rg.Vector3d(0, 0, -fc_bb.Min.Z))

    _fc_len = fc_flat.GetLength()
    _fc_closed = fc_flat.IsClosed

    # ── Detect setback: if next floor has a smaller footprint ──────────────
    # Podium/Tower (s_type=1): REPLACE outer facade with smaller (tower) curve
    #   — the podium perimeter at transition is a roof, not a wall
    # Stepped (s_type=2) and others: keep current floor's curve as-is
    #   — each step floor uses its own footprint for the facade
    _facade_crv = fc_flat  # default: use this floor's curve
    _is_setback = False
    if fi + 1 < _nf and fi + 1 not in _void_floors:
        next_idx = min(fi + 1, len(_fc_list) - 1)
        next_fc = _fc_list[next_idx]
        next_flat = next_fc.DuplicateCurve()
        next_bb = next_flat.GetBoundingBox(True)
        if abs(next_bb.Min.Z) > 0.01:
            next_flat.Translate(rg.Vector3d(0, 0, -next_bb.Min.Z))

        cur_bb = fc_flat.GetBoundingBox(True)
        cur_w = cur_bb.Max.X - cur_bb.Min.X
        cur_d = cur_bb.Max.Y - cur_bb.Min.Y
        nxt_bb = next_flat.GetBoundingBox(True)
        nxt_w = nxt_bb.Max.X - nxt_bb.Min.X
        nxt_d = nxt_bb.Max.Y - nxt_bb.Min.Y
        if (nxt_w < cur_w * 0.9) or (nxt_d < cur_d * 0.9):
            _is_setback = True
            # Only replace facade for podium/tower — transition is a roof
            if _stype == 1:
                _facade_crv = next_flat
            debug_lines.append("    setback at fi={}: {}x{} -> {}x{} replace={}".format(
                fi, round(cur_w,1), round(cur_d,1), round(nxt_w,1), round(nxt_d,1), _stype == 1))

    # ── Get void curve for this floor (needed for facade filtering) ─────
    # If facade was replaced with next floor's (tower) curve at setback,
    # use the tower floor's void so it matches the facade size.
    _void_fi = fi
    if _is_setback and _stype == 1:
        _void_fi = min(fi + 1, _nf)
    _void_crv = _make_void(_void_fi) if _has_plan_void else None

    # ── Build facade outline ──────────────────────────────────────────────
    _n_outer = 0
    _n_inner = 0

    if _void_crv is not None and _void_crv.IsClosed:
        if _ptype in (4, 5, 6):
            # L/U/Split: use boolean difference to get the actual slab outline.
            # This single curve follows the building plate exactly — outer edges
            # follow the envelope, void-facing edges follow the void boundary.
            _slab_crvs = []
            try:
                diff = rg.Curve.CreateBooleanDifference(_facade_crv, _void_crv, 0.001)
                if diff and len(diff) > 0:
                    _slab_crvs = list(diff)
            except:
                pass
            if not _slab_crvs:
                _slab_crvs = [_facade_crv]

            for _sc in _slab_crvs:
                try:
                    segs = get_segments(_sc)
                except:
                    segs = []
                for seg in segs:
                    A = seg.PointAtStart
                    B = seg.PointAtEnd
                    gen_panels(A, B, z0, _fh, _wwr, _wtype, _bay,
                               windows_out, wall_panels_out, mullion_lines_out)
                    _n_outer += 1

        elif _is_courtyard:
            # Courtyard: outer perimeter + inner ring as separate facades
            try:
                outer_segs = get_segments(_facade_crv)
            except:
                outer_segs = []
            for seg in outer_segs:
                A = seg.PointAtStart
                B = seg.PointAtEnd
                gen_panels(A, B, z0, _fh, _wwr, _wtype, _bay,
                           windows_out, wall_panels_out, mullion_lines_out)
                _n_outer += 1

            inner_segs = get_segments(_void_crv)
            for seg in inner_segs:
                A = seg.PointAtStart
                B = seg.PointAtEnd
                gen_panels(A, B, z0, _fh, _wwr, _wtype, _bay,
                           windows_out, wall_panels_out, mullion_lines_out)
                _n_inner += 1
    else:
        # Solid plan or no void: just the outer facade
        try:
            outer_segs = get_segments(_facade_crv)
        except:
            outer_segs = []
        for seg in outer_segs:
            A = seg.PointAtStart
            B = seg.PointAtEnd
            gen_panels(A, B, z0, _fh, _wwr, _wtype, _bay,
                       windows_out, wall_panels_out, mullion_lines_out)
            _n_outer += 1

    debug_lines.append("  fi={}: idx={} len={:.1f} closed={} outer={} inner={}".format(
        fi, fc_idx, _fc_len, _fc_closed, _n_outer, _n_inner))
    _win_floors += 1

# ══════════════════════════════════════════════════════════════════════════════
# OUTPUTS
# ══════════════════════════════════════════════════════════════════════════════
windows       = windows_out
wall_panels   = wall_panels_out
mullion_lines = mullion_lines_out

debug_lines.append("RESULT: {} floors, {} windows, {} walls, {} mullions".format(
    _win_floors, len(windows_out), len(wall_panels_out), len(mullion_lines_out)))
out = "\n".join(debug_lines)

# ── Export JSON bundle (connect to gh-params-export windows input) ────────────
export_json = json.dumps({
    "wwRatio": round(_wwr, 3),
    "windowType": _wtype,
    "baySpacing": round(_bay, 3),
    "windowFloors": _win_floors,
    "windowCount": len(windows_out),
    "wallPanelCount": len(wall_panels_out)
})
# ---------- end gh_structure_2 ----------
panel_2 = Panel(gh_zoning_envelope.out)
panel_3 = Panel(gh_zoning_envelope.export_json)

brep = Brep(gh_structure.core_geometry)
solid_union = SolidUnion(Breps=brep)
geometry = Geometry(flatten([gh_massing.building_mass, gh_massing.stilt_columns, solid_union]))
solid_union_2 = SolidUnion(Breps=geometry)
bounding_box = BoundingBox(Content=solid_union_2, Plane=PlaneXY(0, 0, 0), UnionBox=True)  # -> Box, Box_2
volume = Volume(Geometry=bounding_box.Box)  # -> Volume, Centroid
project_along = ProjectAlong(Geometry=volume.Centroid, Plane=PlaneXY(0, 0, 0), Direction=Vector(0, 0, -1))  # -> Geometry, Transform
unit_x = UnitX(Factor=Slider(400, range=0..1000))
move = Move(Geometry=project_along.Geometry, Motion=unit_x)  # -> Geometry, Transform

brep_2 = Brep(gh_massing.building_mass)  # disabled
deconstruct_brep = DeconstructBrep(Brep=gh_structure.core_geometry)  # -> flatten(Faces), Edges, Vertices
brep_3 = Brep(gh_massing.stilt_columns)

start_day = Slider(1, range=1..31)
end_month = Slider(12, range=1..12)
end_day = Slider(31, range=1..31)
start_month = Slider(1, range=1..12)
start_hour = Slider(0, range=0..23)
end_hour = Slider(23, range=0..23)
analysisperiod = LBAnalysisPeriod(
    start_month=start_month,
    start_day=start_day,
    start_hour=start_hour,
    end_month=end_month,
    end_day=end_day,
    end_hour=end_hour)  # -> period, hoys, dates; plug-in component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

panel_4 = Panel(gh_structure.out)
panel_5 = Panel(gh_structure.export_json)
panel_6 = Panel(gh_massing.out)
panel_7 = Panel(gh_massing.export_json)
mesh_brep = MeshBrep(
    Brep=deconstruct_brep.Faces,
    Settings={GridMaxCount=0, GridMinCount=16, JaggedSeams=False, MaxEdgeLength=1, MinEdgeLength=0.0001, MinTolerance=0, Refine=True, RefineAngle=0, RelativeTolerance=0.65, SimplePlanes=True, Tolerance=0})
curve = Curve(gh_structure.primary_beam_lines)
curve_2 = Curve(gh_structure.secondary_beam_lines)
curve_3 = Curve(gh_structure.column_lines)

cross_section_range_selector_karamba3d = CroSecRSelect(MaximumHeight_cm=-1, MaximumWidth_cm=-1, menu=[dropdown(0), dropdown(1), dropdown(0), dropdown(0)])
material_selection_karamba3d = MatSelect(menu=[dropdown(0), dropdown(1), dropdown(4)])
material_selection_karamba3d_2 = MatSelect(menu=[dropdown(0), dropdown(7), dropdown(1)])
cross_section_selector_karamba3d = CroSecSelect(CrossSections=cross_section_range_selector_karamba3d, Material=material_selection_karamba3d, UseFuzzySearch=False)  # -> CrossSection, Info
cross_section_karamba3d = CroSec(
    FamilyNameOfCrossSection="DefaultCroSec",
    Material=material_selection_karamba3d_2,
    Height_cm=Slider(0.2, range=0..1),
    mode="Shell - Const")
create_linear_element_karamba3d = LineElem(
    Line=curve_3,
    Identifier=gh_structure.col_id,
    CrossSection=cross_section_selector_karamba3d.CrossSection,
    LimitDistance_m=0.005,
    BucklingLengthY_m=-1,
    BucklingLengthZ_m=-1,
    BucklingLengthLT_m=-1,
    Bending=True,
    ToPolylineMaxAngle=0.25,
    ToPolylineTolerance=0.1,
    ToPolylineMaxEdgeLength=0.25,
    New=True,
    Remove=True,
    mode="LineToBeam",
    GuidGeneratorSeed=-1494056716)  # -> Element, Points, Info
create_linear_element_karamba3d_2 = LineElem(
    Line=curve,
    Identifier=gh_structure.primary_id,
    CrossSection=cross_section_selector_karamba3d.CrossSection,
    LimitDistance_m=0.005,
    BucklingLengthY_m=-1,
    BucklingLengthZ_m=-1,
    BucklingLengthLT_m=-1,
    Bending=True,
    ToPolylineMaxAngle=0.25,
    ToPolylineTolerance=0.1,
    ToPolylineMaxEdgeLength=0.25,
    New=True,
    Remove=True,
    mode="LineToBeam",
    GuidGeneratorSeed=-725382922)  # -> Element, Points, Info
create_linear_element_karamba3d_3 = LineElem(
    Line=curve_2,
    Identifier=gh_structure.secondary_id,
    CrossSection=cross_section_selector_karamba3d.CrossSection,
    LimitDistance_m=0.005,
    BucklingLengthY_m=-1,
    BucklingLengthZ_m=-1,
    BucklingLengthLT_m=-1,
    Bending=True,
    ToPolylineMaxAngle=0.25,
    ToPolylineTolerance=0.1,
    ToPolylineMaxEdgeLength=0.25,
    New=True,
    Remove=True,
    mode="LineToBeam",
    GuidGeneratorSeed=-538929041)  # -> Element, Points, Info
support_karamba3d = Supp(
    PosInd=gh_structure.support_points,
    Ct_kN_m=Vector(0, 0, 0),
    Cr_kNm_rad=Vector(0, 0, 0),
    menu=[buttons(on, on, on, on, on, on)])
create_surface_element_karamba3d = SurfElem(Mesh=mesh_brep, CrossSection=cross_section_karamba3d, LimitDistance_m=0.005, Bending=True, mode="MeshToShell")  # -> Element, Points, Info
loads_karamba3d = Loads(Vector=gh_structure.gravity_vector, LCase="LC0", mode="Gravity")
assemble_model_karamba3d = Assemble(
    Elem=flatten([create_surface_element_karamba3d.Element, create_linear_element_karamba3d.Element, create_linear_element_karamba3d_2.Element, create_linear_element_karamba3d_3.Element]),
    Support=support_karamba3d,
    Load=loads_karamba3d,
    LimitDistance_m=Slider(0.5, range=0..1))  # -> Model, Info, Mass_kg, CentreOfGravity, LoadCaseNames
analyse_karamba3d = Analyse(Model=assemble_model_karamba3d.Model)  # -> AnalysedModel, MaximumDisplacement_cm, ResultingForce_kN, ChangeOfElasticEnergy_kNm
gh_karamba_extract = Python3Script(
    max_disp=analyse_karamba3d.MaximumDisplacement_cm,
    floors=python_3_script.floors,
    floor_height=python_3_script.floor_height)  # -> out, k_utilization, k_maxDeflection, k_lateralDrift, export_json
# ---------- gh_karamba_extract: Python ----------
# ArchSim Karamba Result Extractor
# ─────────────────────────────────────────────────────────────────────────────
# Extracts usable numbers from Karamba analysis for ArchSim Export.
#
# INPUTS:
#   max_disp        Number  — from Analyse "Maximum Displacement [cm]"
#   floors          Integer — number of floors (same slider as structure script)
#   floor_height    Number  — floor-to-floor height m (same slider)
#
# OUTPUTS:
#   k_utilization      Number — estimated structural utilization 0-1
#   k_maxDeflection    Number — max displacement in mm
#   k_lateralDrift     String — "LOW" / "MODERATE" / "HIGH"
#   export_json        String — JSON bundle of karamba data (connect to gh-params-export)
#   out                String — summary
# ─────────────────────────────────────────────────────────────────────────────

import json

nf = int(floors) if floors is not None else 10
fh = float(floor_height) if floor_height is not None else 3.6
H = nf * fh  # total height in meters

# Max displacement (Karamba outputs in cm)
disp_cm = float(max_disp) if max_disp is not None else 0.0
k_maxDeflection = disp_cm * 10.0  # convert cm to mm

# Rigid body modes (0 = stable)
_rigid = 0
if "rigid_modes" in dir() and rigid_modes is not None:
    try:
        _rigid = int(rigid_modes)
    except:
        _rigid = 0

# Lateral drift assessment: H/delta ratio
# H in mm, disp in mm
if k_maxDeflection > 0.001:
    H_mm = H * 1000.0
    drift_ratio = H_mm / k_maxDeflection
    if drift_ratio > 500:
        k_lateralDrift = "LOW"
    elif drift_ratio > 250:
        k_lateralDrift = "MODERATE"
    else:
        k_lateralDrift = "HIGH"
else:
    drift_ratio = 99999
    k_lateralDrift = "LOW"

# Utilization estimate from deflection limit
# Allowable = H/500 for office (serviceability)
allowable_mm = H * 1000.0 / 500.0
k_utilization = round(min(k_maxDeflection / allowable_mm, 1.0), 3) if allowable_mm > 0 else 0.0

out = (
    "Deflection: {:.1f} mm ({:.2f} cm)\n"
    "Allowable (H/500): {:.1f} mm\n"
    "Utilization: {:.1%}\n"
    "Drift ratio: H/{:.0f} -> {}"
).format(
    k_maxDeflection, disp_cm,
    allowable_mm,
    k_utilization,
    drift_ratio, k_lateralDrift
)

if _rigid > 0:
    out = "WARNING: {} rigid body modes (unstable)\n\n{}".format(_rigid, out)

# ── Export JSON bundle (connect to gh-params-export karamba input) ─
export_json = json.dumps({
    "utilization": k_utilization,
    "maxDeflection": round(k_maxDeflection, 2),
    "lateralDrift": k_lateralDrift,
    "driftRatio": round(drift_ratio, 1),
    "rigidBodyModes": _rigid,
    "stable": _rigid == 0
})
# ---------- end gh_karamba_extract ----------
model_view_karamba3d = ModelView(Model=analyse_karamba3d.AnalysedModel)  # -> Model, DeformedMesh, DeformedAxes, DeformedModel, MaximumDeformation
beam_view_karamba3d = BeamView(Model=analyse_karamba3d.AnalysedModel)  # -> Model, MeshesOfRenderedBeams, DeformedBeamAxes, LegendColours, LegendTags
panel_8 = Panel(gh_karamba_extract.out)

colour_swatch = ColourSwatch(SwatchColor=RGB(180, 180, 180))
custom_preview = CustomPreview(Geometry=brep_3, Material=colour_swatch)
custom_preview_2 = CustomPreview(Geometry=gh_massing.floor_slabs, Material=colour_swatch)
custom_preview_3 = CustomPreview(Geometry=gh_structure_2.windows, Material=ColourSwatch(SwatchColor=RGBA(180, 180, 180, 120)))
custom_preview_4 = CustomPreview(Geometry=gh_structure_2.wall_panels, Material=ColourSwatch(SwatchColor=RGB(180, 180, 180)))
custom_preview_5 = CustomPreview(Geometry=mesh_brep, Material=ColourSwatch(SwatchColor=RGB(180, 180, 180)))
panel_9 = Panel(gh_karamba_extract.export_json)
building_use = ValueList({"Office": "office", "Residential": "residential", "Mixed": "mixed", "Retail": "retail", "Industrial": "industrial", "Institutional": "institutional"}, selected="Mixed")
boolean_toggle = BooleanToggle(True)

panel_10 = Panel("https://climate.onebuilding.org/WMO_Region_4_North_and_Central_America/CAN_Canada/BC_British_Columbia/CAN_BC_Vancouver.Intl.AP.718920_TDY-CWEC2020v2.zip")
file_path = FilePath("C:\Users\Karl\Documents\UBC\MArch Yr3\Arch 549 GP2\01_Assignment\Ladybug_epw\")
downloadepw = LBDownloadWeather(weather_URL=panel_10, folder=file_path)  # -> epw_file, stat_file, ddy_file; plug-in component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
importepw = LBImportEPW(epw_file=downloadepw.epw_file)  # -> location, dry_bulb_temperature, dew_point_temperature, relative_humidity, wind_speed, wind_direction, direct_normal_rad, diffuse_horizontal_rad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; plug-in component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
panel_11 = Panel(importepw.location)
offset_dist = Slider(0.01, range=0..0.01)
context = Geometry([<brep referenced from the Rhino model> x2])

sunpath = LBSunPath(
    location=importepw.location,
    hoys=analysisperiod.hoys,
    center_pt=project_along.Geometry,
    scale=1,
    data=importepw.dry_bulb_temperature)  # -> out, vectors, altitudes, azimuths, hoys, sun_pts, analemma, daily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; plug-in component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
custom_preview_6 = CustomPreview(Geometry=sunpath.analemma, Material=ColourSwatch(SwatchColor=RGB(250, 225, 77)))
custom_preview_7 = CustomPreview(Geometry=[sunpath.daily, sunpath.compass], Material=ColourSwatch(SwatchColor=RGB(2, 2, 2)))
directsunhours = LBDirectSunHours(
    vectors=flatten(sunpath.vectors),
    geometry=flatten(solid_union_2),
    context=flatten(context),
    grid_size="1",
    offset_dist=offset_dist,
    run=Toggle(True))  # -> out, points, results, mesh, legend, title, int_mtx; plug-in component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

skymatrix = LBCumulativeSkyMatrix(
    location=importepw.location,
    direct_rad=importepw.direct_normal_rad,
    diffuse_rad=importepw.diffuse_horizontal_rad,
    hoys=analysisperiod.hoys)  # -> out, sky_mtx; plug-in component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
skydome = LBSkyDome(sky_mtx=skymatrix.sky_mtx, center_pt=move.Geometry)  # -> out, mesh, compass, legend, title, patch_vecs, patch_values, mesh_values, vis_set; plug-in component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
incidentradiation = LBIncidentRadiation(
    sky_mtx=skymatrix.sky_mtx,
    geometry=flatten(solid_union_2),
    context=flatten(context),
    grid_size="1",
    offset_dist=offset_dist,
    run=Toggle(True))  # -> out, points, results, total, mesh, legend, title, int_mtx; plug-in component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

panel_12 = Panel(directsunhours.results)
panel_13 = Panel(incidentradiation.results)
python_3_script_2 = Python3Script(radiation_values=incidentradiation.results, sun_hours=directsunhours.results)  # -> out, lb_annualSolarHours, lb_avgRadiation, lb_peakRadiation, lb_overheatingRisk, export_json; inputs radiation_values: list, sun_hours: list, face_areas: list
# ---------- python_3_script_2: Python ----------
# ArchSim Ladybug Result Extractor
# ─────────────────────────────────────────────────────────────────────────────
# Extracts usable numbers from a Ladybug analysis and bundles them into
# export_json for gh-params-export.py. Mirrors gh-karamba-extract.py.
#
# Feed this node the outputs of your Ladybug components (Incident Radiation,
# Direct Sun Hours, etc). All inputs are lists of numbers — one value per
# analysis point on the facade / roof mesh.
#
# INPUTS (wire from your Ladybug definition):
#   radiation_values  List<Number> — annual radiation per facade point, kWh/m²
#                                    (from LB Incident Radiation "results")
#   sun_hours         List<Number> — annual direct sun hours per facade point
#                                    (from LB Direct Sun Hours "results")
#   face_areas        List<Number> — area of each analysis face, m² (optional;
#                                    enables area-weighted averages). If empty,
#                                    a simple arithmetic mean is used.
#
# OUTPUTS (rename slots on the component to match these names):
#   lb_annualSolarHours   Number — avg annual direct sun hours on facade
#   lb_avgRadiation       Number — avg annual radiation on facade, kWh/m²
#   lb_peakRadiation      Number — peak facade radiation, kWh/m²
#   lb_overheatingRisk    String — "LOW"/"MODERATE"/"HIGH"
#   export_json           String — JSON bundle (→ gh-params-export ladybug input)
#   summary               String — human-readable summary
#
# NOTE: EUI is NOT computed here — that depends on buildingUse and belongs
# on the JS side (hops.js / mep.js) where buildingUse is already in params.
# This extractor only outputs what Ladybug actually measures.
# ─────────────────────────────────────────────────────────────────────────────

import json

def _flt_list(src):
    if src is None:
        return []
    result = []
    try:
        it = list(src)
    except:
        it = [src]
    for v in it:
        if v is None:
            continue
        try:
            result.append(float(v))
        except:
            pass
    return result

_rad   = _flt_list(radiation_values)
_sun   = _flt_list(sun_hours)
_areas = _flt_list(face_areas)

def _mean(vals, weights=None):
    if not vals:
        return 0.0
    if weights and len(weights) == len(vals):
        wsum = sum(weights)
        if wsum > 0:
            return sum(v * w for v, w in zip(vals, weights)) / wsum
    return sum(vals) / len(vals)

# ── Solar / radiation metrics ────────────────────────────────────────────────
lb_annualSolarHours = round(_mean(_sun, _areas if _areas else None), 0)
lb_avgRadiation     = round(_mean(_rad, _areas if _areas else None), 1)
lb_peakRadiation    = round(max(_rad), 1) if _rad else 0.0

# ── Overheating risk from avg facade radiation ──────────────────────────────
# Vancouver climate (climate zone 5). Typical annual facade radiation ranges:
#   < 400 kWh/m²     → LOW  (mostly shaded / north-facing dominant)
#   400-700 kWh/m²   → MODERATE
#   > 700 kWh/m²     → HIGH (south/west-heavy, high glazing ratio)
if lb_avgRadiation >= 700:
    lb_overheatingRisk = "HIGH"
elif lb_avgRadiation >= 400:
    lb_overheatingRisk = "MODERATE"
else:
    lb_overheatingRisk = "LOW"

# ── Summary ──────────────────────────────────────────────────────────────────
summary = (
    "Facade points analysed: {} (rad) / {} (sun)\n"
    "Avg radiation: {} kWh/m2   Peak: {} kWh/m2\n"
    "Avg sun hours: {} hrs/year\n"
    "Overheating risk: {}"
).format(
    len(_rad), len(_sun),
    lb_avgRadiation, lb_peakRadiation,
    int(lb_annualSolarHours),
    lb_overheatingRisk
)

if not _rad and not _sun:
    summary = "WARNING: no Ladybug data wired in (radiation_values / sun_hours both empty)\n\n" + summary

# Also assign to print buffer so it shows in the default `out` output too
print(summary)

# ── Export JSON bundle (connect to gh-params-export ladybug input) ──────────
export_json = json.dumps({
    "annualSolarHours":  lb_annualSolarHours,
    "avgRadiation":      lb_avgRadiation,
    "peakRadiation":     lb_peakRadiation,
    "overheatingRisk":   lb_overheatingRisk,
    "pointCount":        len(_rad),
    "source":            "ladybug"
})
# ---------- end python_3_script_2 ----------
panel_14 = Panel(python_3_script_2.export_json)
panel_15 = Panel(python_3_script_2.out)

gh_params_export = Python3Script(
    export=boolean_toggle,
    buildingUse=building_use,
    zoning=gh_zoning_envelope.export_json,
    massing=gh_massing.export_json,
    structure=gh_structure.export_json,
    windows=gh_structure_2.export_json_2,
    karamba=gh_karamba_extract.export_json,
    ladybug=python_3_script_2.export_json,
    snapshot_enable=boolean_toggle,
    roundToken=python_3_script.roundToken)  # -> out; inputs view_names: list
# ---------- gh_params_export: Python ----------
# ArchSim GH Params Exporter (+ Snapshot + History + Manifest)
# ─────────────────────────────────────────────────────────────────────────────
# Collects data from all upstream GH scripts, writes params.json, and captures
# a batch of named-view JPGs. Builds a round-by-round history + manifest so the
# JS app can browse / compare previous design rounds.
#
# INPUTS:
#   export             Boolean      — toggle True to write + capture
#   floorplate         Number       — fallback only; derived from massing if wired
#   buildingUse        String       — office / residential / mixed / retail / ...
#
#   # Grouped JSON inputs (connect export_json output from each script):
#   zoning             String       — from gh_zoning_envelope.py
#   massing            String       — from gh-massing.py
#   structure          String       — from gh-structure.py
#   karamba            String       — from gh-karamba-extract.py
#   windows            String       — from gh-windows.py
#   ladybug            String       — from gh-ladybug-extract.py
#
#   # Snapshot inputs (NEW — add these to the component):
#   view_names         List<String> — named views to capture, e.g.
#                                     Parallel_NE / Parallel_NW / Parallel_SE / Parallel_SW
#                                     List Access. If empty, uses the 4 defaults above.
#   snapshot_enable    Boolean      — optional, Item Access. Default True.
#                                     Wire a toggle if you want to disable capture.
#
#   # Round-token roundtrip input (NEW):
#   roundToken         String       — Item Access. Wire from
#                                     gh-inputs-read.roundToken. Echoed into
#                                     params.json so core/roundSync.js in the
#                                     app can detect when *this* round's solve
#                                     has completed (and not a stale previous
#                                     one). Optional — if not wired, the field
#                                     is omitted from params.json.
#
# OUTPUT:
#   out                String       — multi-line status summary
#
# BEHAVIOUR:
#   • Hash check: if data (excluding timestamp) is identical to the last written
#     round, skip everything. Lets you spam the export button safely.
#   • On change detected:
#       1. Write snapshots/latest/params.json  + overwrite latest/{view}.jpg
#       2. Copy everything into snapshots/history/{YYYYMMDD_HHMMSS}/
#       3. Append round entry to snapshots/manifest.json  (trim to last 50)
#       4. Also still writes the top-level params.json for backward compat.
#
# FOLDER LAYOUT (all under PROJECT_PATH/snapshots):
#   latest/
#       Parallel_NE.jpg, Parallel_NW.jpg, Parallel_SE.jpg, Parallel_SW.jpg
#       params.json
#   history/
#       20260410_161233/   ← one folder per round
#           Parallel_*.jpg
#           params.json
#       20260410_164512/
#           ...
#   manifest.json    ← summary index for the JS comparison UI
#   .params_hash.txt ← sidecar for change detection (internal)
# ─────────────────────────────────────────────────────────────────────────────

import json
import os
import hashlib
import shutil

# Rhino imports (available in GHPython runtime)
import Rhino
import System.Drawing as sd
import System.Drawing.Imaging as sdi

# ── Config ────────────────────────────────────────────────────────────────────
PROJECT_PATH = r"C:\Users\Karl\Documents\UBC\MArch Yr3\Arch 549 GP2\01_Assignment\app\ClaudeCode\Claude_Project_ArchSimV2"
OUTPUT_FILE = os.path.join(PROJECT_PATH, "params.json")

SNAPSHOT_ROOT = os.path.join(PROJECT_PATH, "snapshots")
LATEST_DIR    = os.path.join(SNAPSHOT_ROOT, "latest")
HISTORY_DIR   = os.path.join(SNAPSHOT_ROOT, "history")
ARCHIVE_DIR   = os.path.join(SNAPSHOT_ROOT, "archive")   # per-session dumps
MANIFEST_FILE = os.path.join(SNAPSHOT_ROOT, "manifest.json")
HASH_FILE     = os.path.join(SNAPSHOT_ROOT, ".params_hash.txt")
SESSION_FILE  = os.path.join(SNAPSHOT_ROOT, ".session.json")  # written by serve.py

DEFAULT_VIEW_NAMES = ["Parallel_NE", "Parallel_NW", "Parallel_SE", "Parallel_SW"]
SNAPSHOT_W = 1920
SNAPSHOT_H = 1080
HISTORY_KEEP = 50  # retention cap; older rounds deleted after this

# ── Helpers ───────────────────────────────────────────────────────────────────
def safe_parse(json_str):
    """Parse a JSON string input. Returns dict or empty dict."""
    if json_str is None or str(json_str).strip() in ("", "None"):
        return {}
    try:
        return json.loads(str(json_str))
    except:
        return {}

def _ensure_dir(p):
    if not os.path.exists(p):
        os.makedirs(p)

def _hash_data(d):
    """Stable MD5 of data dict excluding timestamp field."""
    d2 = dict(d)
    d2.pop("timestamp", None)
    s = json.dumps(d2, sort_keys=True)
    h = hashlib.md5()
    h.update(s.encode("utf-8") if hasattr(s, "encode") else s)
    return h.hexdigest()

def _read_prev_hash():
    if not os.path.exists(HASH_FILE):
        return None
    try:
        with open(HASH_FILE, "r") as f:
            return f.read().strip()
    except:
        return None

def _write_hash(h):
    _ensure_dir(SNAPSHOT_ROOT)
    with open(HASH_FILE, "w") as f:
        f.write(h)

def _capture_named_view(view_name, out_path):
    """Restore a Rhino Named View into the active viewport, then capture a JPG
    at SNAPSHOT_W x SNAPSHOT_H. Returns (ok, message).

    Note: mutates the active viewport's camera. We save the previous viewport
    state before each call in the batch loop and restore it at the end, so the
    user's working view isn't permanently changed."""
    doc = Rhino.RhinoDoc.ActiveDoc
    nv_table = doc.NamedViews
    idx = nv_table.FindByName(view_name)
    if idx < 0:
        return (False, "named view '{}' not found".format(view_name))

    active_view = doc.Views.ActiveView
    if active_view is None:
        return (False, "no active viewport to capture into")

    try:
        # Restore the named view into the active viewport
        ok = nv_table.Restore(idx, active_view.ActiveViewport)
        if not ok:
            return (False, "NamedViews.Restore failed for '{}'".format(view_name))
        active_view.Redraw()

        vc = Rhino.Display.ViewCapture()
        vc.Width = SNAPSHOT_W
        vc.Height = SNAPSHOT_H
        vc.ScaleScreenItems = False
        vc.DrawAxes = False
        vc.DrawGrid = False
        vc.DrawGridAxes = False
        vc.TransparentBackground = False
        bmp = vc.CaptureToBitmap(active_view)
        if bmp is None:
            return (False, "capture returned None for '{}'".format(view_name))
        bmp.Save(out_path, sdi.ImageFormat.Jpeg)
        return (True, "OK")
    except Exception as e:
        return (False, "{}: {}".format(view_name, str(e)))

def _load_manifest():
    if not os.path.exists(MANIFEST_FILE):
        return {"rounds": [], "lastRoundNumber": 0, "sessionId": None}
    try:
        with open(MANIFEST_FILE, "r") as f:
            m = json.load(f)
        if "rounds" not in m:
            m["rounds"] = []
        if "lastRoundNumber" not in m:
            # back-fill for old manifests: take max existing number, else 0
            nums = [r.get("roundNumber", 0) for r in m["rounds"]]
            m["lastRoundNumber"] = max(nums) if nums else 0
        if "sessionId" not in m:
            m["sessionId"] = None
        return m
    except:
        return {"rounds": [], "lastRoundNumber": 0, "sessionId": None}

def _save_manifest(m):
    _ensure_dir(SNAPSHOT_ROOT)
    with open(MANIFEST_FILE, "w") as f:
        json.dump(m, f, indent=2)

def _round_summary(data):
    """Pluck key numbers from the full data dict for the manifest entry.
    JS reads this to render the round list without opening each round's
    params.json."""
    m = data.get("massing", {}) or {}
    k = data.get("karamba", {}) or {}
    l = data.get("ladybug", {}) or {}
    w = data.get("windows", {}) or {}
    s = data.get("structure", {}) or {}
    return {
        "roundNumber":     data.get("roundNumber"),
        "roundLabel":      data.get("roundLabel"),
        "floors":          data.get("floors"),
        "floorplate":      data.get("floorplate"),
        "totalGFA":        round(float(data.get("floors", 0)) * float(data.get("floorplate", 0)), 1),
        "height":          data.get("height"),
        "structuralSpan":  data.get("structuralSpan"),
        "wwRatio":         data.get("wwRatio"),
        "orientation":     data.get("orientation"),
        "buildingUse":     data.get("buildingUse"),
        "massingType": "{} + {} + {}".format(
            m.get("baseShapeName", "?"),
            m.get("sectionTypeName", "?"),
            m.get("planTypeName", "?"),
        ) if m else None,
        "efficiency":      m.get("efficiency"),
        "maxDeflection":   k.get("maxDeflection"),
        "utilization":     k.get("utilization"),
        "lateralDrift":    k.get("lateralDrift"),
        "rigidBodyModes":  k.get("rigidBodyModes"),
        "avgRadiation":    l.get("avgRadiation"),
        "peakRadiation":   l.get("peakRadiation"),
        "annualSolarHours":l.get("annualSolarHours"),
        "overheatingRisk": l.get("overheatingRisk"),
        "windowType":      w.get("windowTypeName") or data.get("windowType"),
    }

def _read_session_marker():
    """Read snapshots/.session.json written by serve.py when the app submits
    a new Client Brief. Returns dict with sessionId / startedAt / brief, or
    None if missing/unreadable."""
    if not os.path.exists(SESSION_FILE):
        return None
    try:
        with open(SESSION_FILE, "r") as f:
            return json.load(f)
    except:
        return None

def _archive_current_session(old_session_id):
    """Move latest/, history/, manifest.json, .params_hash.txt into
    archive/{old_session_id}/ so the next session starts from a clean slate.
    Returns (moved_count, message)."""
    if not old_session_id:
        old_session_id = "unknown_" + str(hash(MANIFEST_FILE))
    dest = os.path.join(ARCHIVE_DIR, old_session_id)
    _ensure_dir(ARCHIVE_DIR)
    # If a folder with this id already exists (e.g. double-click), suffix it
    if os.path.exists(dest):
        i = 2
        while os.path.exists(dest + "_" + str(i)):
            i += 1
        dest = dest + "_" + str(i)
    _ensure_dir(dest)

    moved = 0
    for src in (LATEST_DIR, HISTORY_DIR):
        if os.path.exists(src):
            try:
                shutil.move(src, os.path.join(dest, os.path.basename(src)))
                moved += 1
            except:
                pass
    for src in (MANIFEST_FILE, HASH_FILE):
        if os.path.exists(src):
            try:
                shutil.move(src, os.path.join(dest, os.path.basename(src)))
                moved += 1
            except:
                pass
    return (moved, dest)

def _trim_history(keep_n):
    """Delete oldest history folders beyond retention cap. Does NOT touch
    latest/ or the manifest (manifest trimmed separately). Sorts by the
    embedded datetime portion of the folder name (after the R### prefix) so
    that R001_… through R999_… are ordered chronologically rather than
    lexically when round numbers wrap past the 3-digit pad width."""
    if not os.path.exists(HISTORY_DIR):
        return 0
    entries = [e for e in os.listdir(HISTORY_DIR) if os.path.isdir(os.path.join(HISTORY_DIR, e))]

    def _sort_key(name):
        # Accept both legacy "YYYYMMDD_HHMMSS" and new "R###_YYYYMMDD_HHMMSS".
        parts = name.split("_", 1)
        if parts[0].startswith("R") and len(parts) == 2:
            return parts[1]  # datetime portion
        return name

    entries.sort(key=_sort_key)
    removed = 0
    while len(entries) > keep_n:
        victim = entries.pop(0)
        try:
            shutil.rmtree(os.path.join(HISTORY_DIR, victim))
            removed += 1
        except:
            pass
    return removed

# ═════════════════════════════════════════════════════════════════════════════
# MAIN
# ═════════════════════════════════════════════════════════════════════════════
status = "Toggle [export] to True to write params.json + capture snapshots"

if export:
    # ── Parse grouped inputs ─────────────────────────────────────────────────
    zoning_data    = safe_parse(zoning)
    massing_data   = safe_parse(massing)
    structure_data = safe_parse(structure)
    karamba_data   = safe_parse(karamba)
    windows_data   = safe_parse(windows)
    ladybug_data   = safe_parse(ladybug) if "ladybug" in dir() else {}

    # ── Reconstruct top-level params from grouped data ───────────────────────
    _floors  = massing_data.get("floors", 10)
    _fh      = massing_data.get("floorHeight", 3.6)
    _ori     = massing_data.get("orientation", 0)
    _span    = structure_data.get("structuralSpan", 8.0)
    _wwr     = windows_data.get("wwRatio", 0.4)
    _wtype   = windows_data.get("windowType", 0)
    _bay     = windows_data.get("baySpacing", 1.5)
    # floorplate: derive from massing total GFA / floors. Fallback to panel.
    _fp = None
    try:
        _gfa = massing_data.get("massingArea", None)
        if _gfa is not None and _floors and _floors > 0:
            _fp = round(float(_gfa) / float(_floors), 1)
    except:
        _fp = None
    if _fp is None:
        try:
            _fp = float(floorplate) if floorplate is not None else 800
        except:
            _fp = 800
    _use     = str(buildingUse)  if buildingUse is not None else "office"

    import datetime
    _now = datetime.datetime.now()
    _ts_human = _now.strftime("%Y-%m-%d %H:%M:%S")
    _ts_id    = _now.strftime("%Y%m%d_%H%M%S")  # folder-safe datetime

    # ── Session handshake ────────────────────────────────────────────────────
    # The JS app writes snapshots/.session.json via serve.py every time the
    # user submits a new Client Brief. If the sessionId there differs from
    # the one recorded in our manifest, we archive everything from the old
    # session into archive/{oldSessionId}/ and start a fresh manifest at R001.
    _session_marker = _read_session_marker()
    _current_sid    = _session_marker.get("sessionId") if _session_marker else None
    _peek_manifest  = _load_manifest()
    _manifest_sid   = _peek_manifest.get("sessionId")
    _session_note   = ""

    if _current_sid and _current_sid != _manifest_sid:
        # Only archive if there's actually something to archive
        if _peek_manifest.get("rounds") or os.path.exists(HISTORY_DIR) or os.path.exists(LATEST_DIR):
            _moved, _dest = _archive_current_session(_manifest_sid or "legacy")
            _session_note = "NEW SESSION — archived {} item(s) to {}".format(_moved, os.path.basename(_dest))
        else:
            _session_note = "NEW SESSION — {}".format(_current_sid)
        # Fresh manifest for the new session
        _peek_manifest = {"rounds": [], "lastRoundNumber": 0, "sessionId": _current_sid}
        # Persist immediately so a mid-round crash still remembers the sid
        _save_manifest(_peek_manifest)

    # Peek at manifest to get the next round number (monotonic within session —
    # never resets from trimming, only resets on new Client Brief).
    _round_number   = _peek_manifest.get("lastRoundNumber", 0) + 1
    _round_label    = "R{:03d}".format(_round_number)  # R001, R042, R128…
    _round_id       = "{}_{}".format(_round_label, _ts_id)  # R042_20260410_161233

    data = {
        "source": "grasshopper",
        "timestamp": _ts_human,
        "roundId":   _round_id,
        "roundNumber": _round_number,
        "roundLabel":  _round_label,

        "floors":          _floors,
        "floorplate":      _fp,
        "floorHeight":     _fh,
        "height":          _floors * _fh,
        "structuralSpan":  _span,
        "wwRatio":         _wwr,
        "orientation":     _ori,
        "buildingUse":     _use,
        "windowType":      _wtype,
        "baySpacing":      _bay,
        "ghConnected":     True,
    }

    # ── Round-token echo (for core/roundSync.js) ─────────────────────────────
    # The app writes a roundToken into .gh-inputs.json at the start of each
    # round; gh-inputs-read.py passes it through and we echo it here so the
    # app can poll params.json and match the token to know *this* round's
    # solve is done (rather than reading a stale file from a previous round).
    if "roundToken" in dir() and roundToken is not None:
        try:
            _rt = str(roundToken).strip()
            if _rt:
                data["roundToken"] = _rt
        except:
            pass

    # ── Attach grouped data as nested objects ────────────────────────────────
    if structure_data:
        data["structuralSpanX"] = structure_data.get("structuralSpanX", _span)
        data["structuralSpanY"] = structure_data.get("structuralSpanY", _span)
        data["structure"] = structure_data
    if zoning_data:    data["zoning"]   = zoning_data
    if massing_data:   data["massing"]  = massing_data
    if karamba_data:   data["karamba"]  = karamba_data
    if windows_data:   data["windows"]  = windows_data
    if ladybug_data:   data["ladybug"]  = ladybug_data

    # ── Hash check: skip if unchanged since last round ───────────────────────
    curr_hash  = _hash_data(data)
    prev_hash  = _read_prev_hash()
    unchanged  = (prev_hash == curr_hash) and os.path.exists(OUTPUT_FILE)

    snapshot_report = []  # populated below

    try:
        if unchanged:
            status_lines = ["SKIPPED — no changes since last round ({})".format(prev_hash[:8])]
            status = "\n".join(status_lines)
        else:
            # ── Write top-level params.json ────────────────────────────────
            with open(OUTPUT_FILE, "w") as f:
                json.dump(data, f, indent=2)

            # ── Resolve view names ─────────────────────────────────────────
            _views = []
            if "view_names" in dir() and view_names is not None:
                try:
                    _views = [str(v) for v in list(view_names) if v is not None and str(v).strip()]
                except:
                    _views = []
            if not _views:
                _views = list(DEFAULT_VIEW_NAMES)

            # ── Resolve snapshot_enable toggle (defaults to True) ──────────
            _snap_enable = True
            if "snapshot_enable" in dir() and snapshot_enable is not None:
                try:
                    _snap_enable = bool(snapshot_enable)
                except:
                    _snap_enable = True

            if _snap_enable:
                # ── Prepare folders ────────────────────────────────────────
                _ensure_dir(SNAPSHOT_ROOT)
                _ensure_dir(LATEST_DIR)
                _ensure_dir(HISTORY_DIR)
                round_dir = os.path.join(HISTORY_DIR, _round_id)
                _ensure_dir(round_dir)

                # Save the active viewport's current camera so we can restore
                # it after the batch — capturing named views mutates it.
                _saved_vp = None
                try:
                    _active = Rhino.RhinoDoc.ActiveDoc.Views.ActiveView
                    if _active is not None:
                        _saved_vp = _active.ActiveViewport.GetViewInfo()
                except:
                    _saved_vp = None

                # ── PASS 1: capture all N views to a staging folder inside
                #    history/. If any fail, the whole round is rolled back so
                #    the comparison UI never sees a partial round. Only after
                #    all N succeed do we promote them to latest/.
                staging_ok    = True
                staging_paths = []   # list of (view, staging_path)

                for vn in _views:
                    staging_path = os.path.join(round_dir, vn + ".jpg")
                    ok, msg = _capture_named_view(vn, staging_path)
                    if ok:
                        snapshot_report.append((vn, True, "OK"))
                        staging_paths.append((vn, staging_path))
                    else:
                        snapshot_report.append((vn, False, msg))
                        staging_ok = False

                # Restore the user's original camera regardless of outcome
                if _saved_vp is not None:
                    try:
                        _active = Rhino.RhinoDoc.ActiveDoc.Views.ActiveView
                        if _active is not None:
                            _active.ActiveViewport.PushViewInfo(_saved_vp, False)
                            _active.Redraw()
                    except:
                        pass

                # ── PASS 2: commit or rollback ──────────────────────────────
                if not staging_ok:
                    # Rollback — delete the staging history folder so we don't
                    # leave an incomplete round on disk. Also: do NOT touch
                    # latest/, do NOT update manifest, do NOT update hash.
                    try:
                        if os.path.exists(round_dir):
                            shutil.rmtree(round_dir)
                    except:
                        pass
                    # Raise so the outer try/except writes a clear error status
                    # and skips manifest + hash updates.
                    raise Exception(
                        "Round {} aborted — {}/{} views failed. Check Named View names in Rhino.".format(
                            _round_label,
                            sum(1 for r in snapshot_report if not r[1]),
                            len(snapshot_report),
                        )
                    )

                # All N succeeded — promote staging copies to latest/
                for vn, staging_path in staging_paths:
                    latest_path = os.path.join(LATEST_DIR, vn + ".jpg")
                    try:
                        shutil.copyfile(staging_path, latest_path)
                    except Exception as e:
                        # A copy failure at this stage is unusual — the disk is
                        # likely full or latest/ is locked. Treat it as a round
                        # failure and rollback.
                        try:
                            if os.path.exists(round_dir):
                                shutil.rmtree(round_dir)
                        except:
                            pass
                        raise Exception("Promote to latest/ failed for {}: {}".format(vn, str(e)))

                # ── Copy params.json into latest/ and history/round_dir ───
                try:
                    shutil.copyfile(OUTPUT_FILE, os.path.join(LATEST_DIR, "params.json"))
                    shutil.copyfile(OUTPUT_FILE, os.path.join(round_dir,  "params.json"))
                except Exception as e:
                    snapshot_report.append(("params.json copy", False, str(e)))

                # ── Update manifest (append + trim to HISTORY_KEEP) ────────
                manifest = _load_manifest()
                # Preserve current sessionId on every write so the next run
                # knows we're still in this session.
                if _current_sid:
                    manifest["sessionId"] = _current_sid
                manifest["rounds"].append({
                    "id":          _round_id,         # R042_20260410_161233
                    "roundNumber": _round_number,     # 42
                    "roundLabel":  _round_label,      # "R042"
                    "datetime":    _ts_id,            # 20260410_161233
                    "timestamp":   _ts_human,         # 2026-04-10 16:12:33
                    "path":        "history/" + _round_id,
                    "hash":        curr_hash,
                    "summary":     _round_summary(data),
                })
                manifest["lastRoundNumber"] = _round_number
                # Trim manifest + history dirs in sync
                if len(manifest["rounds"]) > HISTORY_KEEP:
                    manifest["rounds"] = manifest["rounds"][-HISTORY_KEEP:]
                _save_manifest(manifest)
                _trim_history(HISTORY_KEEP)

            # ── Persist new hash ───────────────────────────────────────────
            _write_hash(curr_hash)

            # ── Build multi-line summary ───────────────────────────────────
            groups = [g for g in ["zoning", "massing", "structure", "karamba", "windows", "ladybug"] if data.get(g)]
            lines = []
            lines.append("OK — {}  ({})".format(_round_label, _ts_human))
            if _session_note:
                lines.append(_session_note)
            if _current_sid:
                lines.append("Session: {}".format(_current_sid))
            lines.append("Round id: {}".format(_round_id))
            lines.append("params.json: {}".format(OUTPUT_FILE))
            lines.append("Groups: {}".format(" + ".join(groups) if groups else "sliders only"))
            lines.append("")
            lines.append("── Core design params ──")
            lines.append("Floors: {}  x  {:.1f}m  =  {:.1f}m total".format(_floors, float(_fh), float(_floors) * float(_fh)))
            lines.append("Floorplate: {} m2   Total GFA: {:.0f} m2".format(_fp, float(_fp) * float(_floors)))
            lines.append("Structural span: {} m   WWR: {:.0%}".format(_span, float(_wwr)))
            lines.append("Orientation: {:.0f} deg   Use: {}".format(float(_ori), _use))

            if massing_data:
                lines.append("")
                lines.append("── Massing ──")
                lines.append("{} + {} + {}".format(
                    massing_data.get("baseShapeName", "?"),
                    massing_data.get("sectionTypeName", "?"),
                    massing_data.get("planTypeName", "?")
                ))
                lines.append("Area: {} m2   Volume: {} m3   Efficiency: {:.1%}".format(
                    massing_data.get("massingArea", 0),
                    massing_data.get("massingVolume", 0),
                    float(massing_data.get("efficiency", 0))
                ))

            if karamba_data:
                lines.append("")
                lines.append("── Structure (Karamba) ──")
                lines.append("Max deflection: {} mm   Utilization: {:.0%}".format(
                    karamba_data.get("maxDeflection", 0),
                    float(karamba_data.get("utilization", 0))
                ))
                lines.append("Drift: H/{}  ({})".format(
                    karamba_data.get("driftRatio", "?"),
                    karamba_data.get("lateralDrift", "?")
                ))
                if karamba_data.get("rigidBodyModes", 0) > 0:
                    lines.append("!! {} rigid body modes — unstable".format(karamba_data.get("rigidBodyModes")))

            if ladybug_data:
                lines.append("")
                lines.append("── Environment (Ladybug) ──")
                lines.append("Avg radiation: {} kWh/m2   Peak: {} kWh/m2".format(
                    ladybug_data.get("avgRadiation", 0),
                    ladybug_data.get("peakRadiation", 0)
                ))
                lines.append("Avg sun hours: {} hrs/year   Overheating: {}".format(
                    int(ladybug_data.get("annualSolarHours", 0)),
                    ladybug_data.get("overheatingRisk", "?")
                ))

            if windows_data:
                lines.append("")
                lines.append("── Windows ──")
                lines.append("Type: {}   WWR: {:.0%}   Bay spacing: {} m".format(
                    windows_data.get("windowTypeName", _wtype),
                    float(windows_data.get("wwRatio", _wwr)),
                    windows_data.get("baySpacing", _bay)
                ))

            if zoning_data:
                lines.append("")
                lines.append("── Zoning ──")
                _maxgfa = zoning_data.get("maxGFA", None)
                if _maxgfa:
                    _used = float(_fp) * float(_floors) / float(_maxgfa)
                    lines.append("Max GFA: {} m2   Used: {:.0%}".format(_maxgfa, _used))
                else:
                    lines.append("(no maxGFA reported)")

            # Snapshot section
            lines.append("")
            if _snap_enable and snapshot_report:
                ok_count   = sum(1 for r in snapshot_report if r[1])
                fail_count = sum(1 for r in snapshot_report if not r[1])
                lines.append("── Snapshots ──")
                lines.append("Captured {}/{}  →  snapshots/latest/ + history/{}/".format(
                    ok_count, len(snapshot_report), _round_id
                ))
                for vn, ok, msg in snapshot_report:
                    tag = "OK " if ok else "FAIL"
                    lines.append("  [{}] {}{}".format(tag, vn, "" if ok else "  — " + msg))
                if fail_count:
                    lines.append("({} failed — check view names in Rhino)".format(fail_count))
            elif not _snap_enable:
                lines.append("── Snapshots ──")
                lines.append("(disabled via snapshot_enable = False)")

            status = "\n".join(lines)

    except Exception as e:
        status = "ERROR: " + str(e)

print(status)
# ---------- end gh_params_export ----------
panel_16 = Panel(gh_params_export)
